# Dynamo graph Test2.dyn (Dynamo 4.0.0.2330)

forceCleanup = DynRenga.DynDocument.Application.ForceCleanup()
getRunningRengaInstances = DynRenga.DynDocument.Application.GetRunningRengaInstances()
getRengaInstanceList = DynRenga.DynDocument.Application.GetRengaInstanceList()
code_block = CodeBlock { 0; }
IApplication = DynRenga.RengaAPI.IApplication.IApplication(instanceIndex=code_block)
IModel = DynRenga.RengaAPI.IModel.IModel(application=IApplication)
getObjects = DynRenga.RengaAPI.IModel.GetObjects(iModel=IModel)
ISelection = DynRenga.RengaAPI.ISelection.ISelection(application=IApplication)
getSelectedObjects = DynRenga.RengaAPI.ISelection.GetSelectedObjects(iSelection=ISelection)
getById = DynRenga.RengaAPI.IModelObjectCollection.GetById(iModelObjectCollection=getObjects, id=getSelectedObjects)
code_block_2 = CodeBlock { "IBaseline2DObject"; }
getInterfaceByName = DynRenga.RengaAPI.IModelObject.GetInterfaceByName(iModelObject=getById, interfaceName=code_block_2)
getBaseline = DynRenga.RengaAPI.IBaseline2DObject.GetBaseline(iBaseline2DObject=getInterfaceByName)
getDebugInfo = DynRenga.Converters.Renga.Geometry2D.Curve2DConverter.GetDebugInfo(curve2D=getBaseline)
getCurveInfo = DynRenga.Converters.Renga.Geometry2D.Curve2DConverter.GetCurveInfo(curve2D=getBaseline)
toDynamoPolyCurveOptimized = DynRenga.Converters.Renga.Geometry2D.Curve2DConverter.ToDynamoPolyCurveOptimized(curve2D=getBaseline)
points = PolyCurve.Points(polyCurve=toDynamoPolyCurveOptimized)
curves = PolyCurve.Curves(polyCurve=toDynamoPolyCurveOptimized)
code_block_3 = CodeBlock(SelectedObjectBaseline=getInterfaceByName) { SelectedObjectBaseline; }
code_block_4 = CodeBlock(model=IModel) { model; }
createOperation = DynRenga.RengaAPI.IModel.CreateOperation(iModel=code_block_4)
startWithDebug = DynRenga.RengaAPI.IOperation.StartWithDebug(iOperation=createOperation)
code_block_5 = CodeBlock(test=startWithDebug.Success, operation=createOperation, pass=code_block_4) { test ? operation : null; test ? pass : null; }
floor = DynRenga.RengaAPI.Constants.ObjectTypes.Floor()
getHostObjectInfo = DynRenga.RengaAPI.IModelObject.GetHostObjectInfo(iModelObject=getById)
code_block_6 = CodeBlock { "HostObjectId"; }
valueAtKey = DesignScript.Builtin.Dictionary.ValueAtKey(dictionary=getHostObjectInfo, key=code_block_6)
code_block_7 = CodeBlock { "ILevelObject"; }
getInterfaceByName_2 = DynRenga.RengaAPI.IModelObject.GetInterfaceByName(iModelObject=getById, interfaceName=code_block_7)
getPlacement = DynRenga.RengaAPI.ILevelObject.GetPlacement(iLevelObject=getInterfaceByName_2)
createObject = DynRenga.RengaAPI.IModel.CreateObject(iModel=code_block_5.out1, typeId=floor, hostObjectId=valueAtKey, placement3D=getPlacement)
code_block_8 = CodeBlock { -0.3; }
code_block_9 = CodeBlock { true; }
offsetMany = PolyCurve.OffsetMany(polyCurve=toDynamoPolyCurveOptimized, signedDistance=code_block_8, extendCircular=code_block_9)
number_slider = DoubleSlider(0.7, range=0..1 step 0.01)
fillet = PolyCurve.Fillet(polyCurve=offsetMany, radius=number_slider)
getMath = DynRenga.RengaAPI.IApplication.GetMath(iApplication=IApplication)
IMath = DynRenga.RengaAPI.IMath.IMath(math=getMath.Math)
fromDynamoPolyCurve = DynRenga.Converters.Dynamo.Geometry2D.PolyCurveConverter.FromDynamoPolyCurve(polyCurve=fillet, math=IMath)
code_block_10 = CodeBlock(test=createObject.Success, operation=code_block_5.out0, pass=createObject.ModelObject, additional=fromDynamoPolyCurve) { test ? operation : null; test ? pass : null; additional; }
applyWithDebug = DynRenga.RengaAPI.IOperation.ApplyWithDebug(iOperation=code_block_10.out0)
code_block_11 = CodeBlock(test=applyWithDebug.Success, operation=code_block_10.out0, pass=code_block_10.out1, additional=code_block_10.additional) { test ? operation : null; test ? pass : null; additional; }
startWithDebug_2 = DynRenga.RengaAPI.IOperation.StartWithDebug(iOperation=code_block_11.out0)
code_block_12 = CodeBlock(test=startWithDebug_2.Success, operation=code_block_11.out0, pass=code_block_11.out1, additional=code_block_11.additional) { test ? operation : null; test ? pass : null; additional; }
code_block_13 = CodeBlock { "IBaseline2DObject"; }
getInterfaceByName_3 = DynRenga.RengaAPI.IModelObject.GetInterfaceByName(iModelObject=code_block_12.out1, interfaceName=code_block_13)
setBaseline = DynRenga.RengaAPI.IBaseline2DObject.SetBaseline(iBaseline2DObject=getInterfaceByName_3, baseline=code_block_12.additional)
code_block_14 = CodeBlock(test=setBaseline.Success, operation=code_block_12.out0, pass=getInterfaceByName_3) { test ? operation : null; test ? pass : null; }
applyWithDebug_2 = DynRenga.RengaAPI.IOperation.ApplyWithDebug(iOperation=code_block_14.out0)
project = DynRenga.RengaAPI.IApplication.Project(iApplication=IApplication)
getObjectInfo = DynRenga.RengaAPI.IModelObject.GetObjectInfo(iModelObject=getById)
setBaselineInCS = DynRenga.RengaAPI.IBaseline2DObject.SetBaselineInCS()  # unwired: iBaseline2DObject, placement2D, baselineInCS
getMathDebugInfo = DynRenga.RengaAPI.IApplication.GetMathDebugInfo(iApplication=IApplication)
getDebugInfo_2 = DynRenga.RengaAPI.ICurve2D.GetDebugInfo(iCurve2D=fromDynamoPolyCurve)
getCurveInfo_2 = DynRenga.Converters.Renga.Geometry2D.Curve2DConverter.GetCurveInfo(curve2D=fromDynamoPolyCurve)
code_block_15 = CodeBlock { 0.3; }
code_block_16 = CodeBlock {  }
refreshBaseline = DynRenga.RengaAPI.IBaseline2DObject.RefreshBaseline(iBaseline2DObject=getInterfaceByName_3)
