# Dynamo graph example_create_floor_from_object_baseline.dyn "Example: Create Floor from Object Baseline" (Dynamo 2.12.0.0)
# Example: Create Floor from Object Baseline

node = (Name="Application.ByProcessName", X=100, Y=100)  # unwired: processName
node_2 = (Application=node, Name="Application.GetProject", X=100, Y=200)
node_3 = (Project=node_2, Name="Project.GetModel", X=100, Y=300)
node_4 = (Model=node_3, Name="Model.GetLevels", X=100, Y=400)
node_5 = (Level=node_4, Name="Level.GetId", X=100, Y=500)
node_6 = (Name="Placement3D.ByOrigin", X=100, Y=600)  # unwired: origin
node_7 = (levelId=node_5, placement3D=node_6, Name="Model.CreateFloorFromObjectBaseline", X=100, Y=700)  # unwired: sourceObjectId
