# Dynamo graph Zones.dyn (Dynamo 4.0.0.2330)

# group: Подготовка и выбор Ренги
forceCleanup = DynRenga.DynDocument.Application.ForceCleanup()
getRunningRengaInstances = DynRenga.DynDocument.Application.GetRunningRengaInstances()
getRengaInstanceList = DynRenga.DynDocument.Application.GetRengaInstanceList()
code_block = CodeBlock { 1; }
IApplication = DynRenga.RengaAPI.IApplication.IApplication(instanceIndex=code_block)

# group: Получение выделенного объекта
IModel = DynRenga.RengaAPI.IModel.IModel(application=IApplication)
getObjects = DynRenga.RengaAPI.IModel.GetObjects(iModel=IModel)
ISelection = DynRenga.RengaAPI.ISelection.ISelection(application=IApplication)
getSelectedObjects = DynRenga.RengaAPI.ISelection.GetSelectedObjects(iSelection=ISelection)
getById = DynRenga.RengaAPI.IModelObjectCollection.GetById(iModelObjectCollection=getObjects, id=getSelectedObjects)

# group: Получение контура
code_block_2 = CodeBlock { "IBaseline2DObject"; }
getInterfaceByName = DynRenga.RengaAPI.IModelObject.GetInterfaceByName(iModelObject=getById, interfaceName=code_block_2)
getBaseline = DynRenga.RengaAPI.IBaseline2DObject.GetBaseline(iBaseline2DObject=getInterfaceByName)

# group: Деление контура на сегменты
toDynamoPolyCurveOptimized = DynRenga.Converters.Renga.Curve2DConverter.ToDynamoPolyCurveOptimized(curve2D=getBaseline)
code_block_3 = CodeBlock(a=toDynamoPolyCurveOptimized) { a[0]; }
python_script = Python(IN[0]=toDynamoPolyCurveOptimized)  # CPython3
# ---------- python_script.python (204 lines) ----------
import clr
clr.AddReference('ProtoGeometry')
from Autodesk.DesignScript.Geometry import *

B_IN = IN[0]
SPLITTERS_IN = IN[1] if len(IN) > 1 and IN[1] is not None else []
EXT = 0.0
EPS = 1e-6

def flatten(lst):
    out = []
    for x in lst if isinstance(lst, (list, tuple)) else [lst]:
        if isinstance(x, (list, tuple)):
            out.extend(flatten(x))
        else:
            out.append(x)
    return out

def to_polycurve_loose(g):
    if isinstance(g, PolyCurve):
        try:
            return PolyCurve.ByJoinedCurves(g.Curves())
        except:
            return g
    if isinstance(g, Polygon):
        return PolyCurve.ByJoinedCurves(list(g.Curves()))
    if isinstance(g, Surface):
        try:
            return PolyCurve.ByJoinedCurves(g.PerimeterCurves())
        except:
            pass
    if isinstance(g, Curve):
        return PolyCurve.ByJoinedCurves([g])
    if isinstance(g, (list, tuple)):
        cs = [c for c in flatten(g) if isinstance(c, Curve)]
        if cs:
            return PolyCurve.ByJoinedCurves(cs)
    return None

def uniq(vals, tol=1e-6):
    vs = sorted(vals)
    out = []
    for v in vs:
        if not out or abs(v - out[-1]) > tol:
            out.append(v)
    return out

def bbox_of_polycurve(pc):
    try:
        return pc.BoundingBox
    except:
        minx=miny=1e99; maxx=maxy=-1e99
        for c in pc.Curves():
            for p in [c.StartPoint, c.EndPoint]:
                minx=min(minx,p.X); maxx=max(maxx,p.X)
                miny=min(miny,p.Y); maxy=max(maxy,p.Y)
        return BoundingBox.ByCorners(Point.ByCoordinates(minx,miny,0), Point.ByCoordinates(maxx,maxy,0))

def collect_vertices(pc):
    pts = []
    try:
        pts = pc.Points()
    except:
        for c in pc.Curves():
            try:
                pts.append(c.StartPoint)
            except:
                pass
        try:
            pts.append(pc.Curves()[-1].EndPoint)
        except:
            pass
    return pts

def point_in_polygon(px, py, verts, eps=1e-9):
    inside = False
    n = len(verts)
    if n < 3: return False
    py_adj = py - eps
    for i in range(n-1):
        x1,y1 = verts[i]; x2,y2 = verts[i+1]
        if abs(y1-y2) <= eps:
            if min(x1,x2)-eps <= px <= max(x1,x2)+eps and abs(py - y1) <= eps:
                return True
            continue
        ymin = min(y1,y2); ymax = max(y1,y2)
        if not (ymin - eps <= py_adj < ymax - eps): continue
        xint = (x2-x1)*(py_adj - y1)/(y2-y1) + x1
        if abs(px - xint) <= eps: return True
        if px < xint: inside = not inside
    return inside

def is_horizontal(line, tol=1e-6):
    return abs(line.StartPoint.Y - line.EndPoint.Y) < tol

def is_vertical(line, tol=1e-6):
    return abs(line.StartPoint.X - line.EndPoint.X) < tol

DEBUG = {"steps": []}
def log(m): DEBUG["steps"].append(str(m))

pc = to_polycurve_loose(B_IN)
if pc is None:
    OUT = [[], {"error":"Could not interpret IN[0] as curves/polycurve", "steps": DEBUG["steps"]}]
else:
    # Get boundary info
    is_closed = getattr(pc, "IsClosed", None)
    crv_count = len(pc.Curves()) if hasattr(pc, "Curves") else None
    log("PolyCurve built. IsClosed=%s, Curves=%s" % (str(is_closed), str(crv_count)))

    # Get boundary vertices
    pts = collect_vertices(pc)
    Xs = [p.X for p in pts]
    Ys = [p.Y for p in pts]
    
    # Get bounding box
    bb = bbox_of_polycurve(pc)
    minp, maxp = bb.MinPoint, bb.MaxPoint
    xmin, xmax = minp.X, maxp.X
    ymin, ymax = minp.Y, maxp.Y

    # Create splitters from input splitters + internal coordinates
    splitters = []
    
    # Add user-provided splitters
    if SPLITTERS_IN:
        user_splitters = flatten(SPLITTERS_IN)
        for ln in user_splitters:
            if isinstance(ln, Curve):
                splitters.append(ln)
    
    # Add internal X coordinates (exclude boundary edges)
    internal_xs = []
    for x in uniq(Xs):
        if x > xmin + EPS and x < xmax - EPS:  # Internal only
            internal_xs.append(x)
    
    # Add internal Y coordinates (exclude boundary edges)  
    internal_ys = []
    for y in uniq(Ys):
        if y > ymin + EPS and y < ymax - EPS:  # Internal only
            internal_ys.append(y)
    
    # Create vertical splitters for internal X coordinates
    for x in internal_xs:
        splitters.append(Line.ByStartPointEndPoint(
            Point.ByCoordinates(x, ymin, 0), 
            Point.ByCoordinates(x, ymax, 0)
        ))
    
    # Create horizontal splitters for internal Y coordinates
    for y in internal_ys:
        splitters.append(Line.ByStartPointEndPoint(
            Point.ByCoordinates(xmin, y, 0), 
            Point.ByCoordinates(xmax, y, 0)
        ))

    # Extract X and Y levels from all splitters
    x_levels = [xmin, xmax]
    y_levels = [ymin, ymax]
    
    for ln in splitters:
        if is_vertical(ln):
            x_levels.append(ln.StartPoint.X)
        elif is_horizontal(ln):
            y_levels.append(ln.StartPoint.Y)
    
    x_levels = uniq(x_levels, EPS)
    y_levels = uniq(y_levels, EPS)
    
    # Get boundary vertices for containment test
    verts = [(p.X, p.Y) for p in pts]
    
    # Create rectangular zones
    zones = []
    for yi in range(len(y_levels)-1):
        y0, y1 = y_levels[yi], y_levels[yi+1]
        for xi in range(len(x_levels)-1):
            x0, x1 = x_levels[xi], x_levels[xi+1]
            
            # Test if rectangle center is inside boundary
            cx, cy = 0.5*(x0+x1), 0.5*(y0+y1)
            if point_in_polygon(cx, cy, verts):
                # Create rectangle
                bl = Point.ByCoordinates(x0, y0, 0)
                br = Point.ByCoordinates(x1, y0, 0)
                tr = Point.ByCoordinates(x1, y1, 0)
                tl = Point.ByCoordinates(x0, y1, 0)
                rect = PolyCurve.ByPoints([bl, br, tr, tl, bl])
                zones.append(rect)

    DEBUG.update({
        "isClosed_reported": is_closed,
        "curve_count": crv_count,
        "vertex_count": len(pts),
        "internal_X": internal_xs,
        "internal_Y": internal_ys,
        "splitters_count": len(splitters),
        "x_levels": x_levels,
        "y_levels": y_levels,
        "zones_created": len(zones)
    })

    OUT = [zones, DEBUG]
# ----------------------------------------
code_block_4 = CodeBlock(a=python_script) { a[0]; }
python_script_2 = Python(IN[0]=code_block_3, IN[1]=code_block_4)  # CPython3
# ---------- python_script_2.python (173 lines) ----------
import clr
clr.AddReference('ProtoGeometry')
from Autodesk.DesignScript.Geometry import *

EPS = 1e-6

def uniq_sorted(vals, tol=1e-6):
    vals = sorted(vals); out = []
    for v in vals:
        if not out or abs(v - out[-1]) > tol: out.append(v)
    return out

def get_local_cs(pc):
    # Нормализация вектора вручную (в некоторых сборках нет Normalize/Normalized)
    def unit(v):
        try:
            L = v.Length
        except:
            # если внезапно пришёл не Vector
            return v
        if L == 0: 
            return v
        return Vector.ByCoordinates(v.X / L, v.Y / L, v.Z / L)

    # 1) пробуем через Surface.ByPatch
    try:
        srf = Surface.ByPatch(pc)
        cs0 = srf.CoordinateSystemAtParameter(0.5, 0.5)
        try: srf.Dispose()
        except: pass
    except:
        # 2) fallback: best-fit plane
        pts = [c.StartPoint for c in pc.Curves()]
        pl = Plane.ByBestFitThroughPoints(pts)
        cs0 = CoordinateSystem.ByPlane(pl)
        for p in pts:
            try: p.Dispose()
            except: pass
        try: pl.Dispose()
        except: pass

    # 3) собираем оси как СВОЙСТВА (не вызываем!)
    o = cs0.Origin
    x = unit(cs0.XAxis)
    y = unit(cs0.YAxis)
    z = unit(cs0.ZAxis)

    # 4) возвращаем корректную КС
    return CoordinateSystem.ByOriginVectors(o, x, y, z)

def to_local_point(pt, cs):
    p = pt.Transform(cs.Inverse())
    return p.X, p.Y, p.Z

def boundary_xy_local(pc, cs):
    verts = []
    for crv in pc.Curves():
        x,y,_ = to_local_point(crv.StartPoint, cs)
        verts.append((x,y))
    xe, ye, _ = to_local_point(pc.Curves()[-1].EndPoint, cs)
    if abs(verts[0][0]-xe)>EPS or abs(verts[0][1]-ye)>EPS:
        verts.append((xe,ye))
    return verts

# --- winding number (устойчивее на вершинах) ---
def wn_point_in_poly(px, py, V, eps=1e-9):
    wn = 0
    n = len(V)-1
    for i in range(n):
        x1,y1 = V[i]; x2,y2 = V[i+1]
        # точка на ребре
        if (min(x1,x2)-eps <= px <= max(x1,x2)+eps and
            min(y1,y2)-eps <= py <= max(y1,y2)+eps):
            if abs((x2-x1)*(py-y1) - (y2-y1)*(px-x1)) <= eps:
                return True
        if y1 <= py:
            if y2 > py and (x2-x1)*(py-y1) - (y2-y1)*(px-x1) > 0: wn += 1
        else:
            if y2 <= py and (x2-x1)*(py-y1) - (y2-y1)*(px-x1) < 0: wn -= 1
    return wn != 0

def orient(ax,ay,bx,by,cx,cy):
    return (bx-ax)*(cy-ay) - (by-ay)*(cx-ax)

def segments_intersect(a,b,c,d, tol=1e-9, touch_ok=True):
    ax,ay=a; bx,by=b; cx,cy=c; dx,dy=d
    o1 = orient(ax,ay,bx,by,cx,cy); o2 = orient(ax,ay,bx,by,dx,dy)
    o3 = orient(cx,cy,dx,dy,ax,ay); o4 = orient(cx,cy,dx,dy,bx,by)
    if (o1*o2 < -tol and o3*o4 < -tol): return True
    def onseg(p,q,r):
        px,py=p; qx,qy=q; rx,ry=r
        return (min(px,rx)-tol <= qx <= max(px,rx)+tol and min(py,ry)-tol <= qy <= max(py,ry)+tol)
    if abs(o1)<=tol and onseg(a,c,b): return not touch_ok
    if abs(o2)<=tol and onseg(a,d,b): return not touch_ok
    if abs(o3)<=tol and onseg(c,a,d): return not touch_ok
    if abs(o4)<=tol and onseg(c,b,d): return not touch_ok
    return False

def rect_inside_strict(x0,y0,x1,y1, V):
    # динамический inset от размера ячейки
    w = abs(x1-x0); h = abs(y1-y0)
    fc = max(0.008, 0.5*EPS/max(w,h,1.0))  # ~0.8% или чуть больше эпсилон/размер
    fe = fc*0.5
    cx,cy = 0.5*(x0+x1), 0.5*(y0+y1)
    # углы + середины рёбер, сдвинутые внутрь
    corners = [(x0+(cx-x0)*fc, y0+(cy-y0)*fc),
               (x1+(cx-x1)*fc, y0+(cy-y0)*fc),
               (x1+(cx-x1)*fc, y1+(cy-y1)*fc),
               (x0+(cx-x0)*fc, y1+(cy-y1)*fc)]
    edges = [(0.5*(x0+x1)+(cx-0.5*(x0+x1))*fe, y0+(cy-y0)*fe),
             (x1+(cx-x1)*fe, 0.5*(y0+y1)+(cy-0.5*(y0+y1))*fe),
             (0.5*(x0+x1)+(cx-0.5*(x0+x1))*fe, y1+(cy-y1)*fe),
             (x0+(cx-x0)*fe, 0.5*(y0+y1)+(cy-0.5*(y0+y1))*fe)]
    if not all(wn_point_in_poly(px,py,V) for (px,py) in corners+edges+[ (cx,cy) ]):
        return False
    # рёбра прямоугольника не должны пересекать границу (кроме касания)
    re = [((x0,y0),(x1,y0)), ((x1,y0),(x1,y1)), ((x1,y1),(x0,y1)), ((x0,y1),(x0,y0))]
    for i in range(len(V)-1):
        e = (V[i], V[i+1])
        for r in re:
            if segments_intersect(r[0], r[1], e[0], e[1], tol=1e-9, touch_ok=True):
                # легкое вдвигание внутрь и повторная проверка
                (px1,py1),(px2,py2) = r
                px1i,py1i = (px1+(cx-px1)*1e-4, py1+(cy-py1)*1e-4)
                px2i,py2i = (px2+(cx-px2)*1e-4, py2+(cy-py2)*1e-4)
                if segments_intersect((px1i,py1i),(px2i,py2i), e[0], e[1], tol=1e-9, touch_ok=True):
                    return False
    return True

# ---------- Inputs ----------
boundary = IN[0]
splitters_in = IN[1] if len(IN)>1 else None
if splitters_in and not isinstance(splitters_in, list): splitters_in=[splitters_in]

if not boundary:
    OUT=[]
else:
    cs = get_local_cs(boundary)
    V = boundary_xy_local(boundary, cs)
    if V[0]!=V[-1]: V.append(V[0])

    # уровни: все X/Y вершин + из сплиттеров (поддержка линий и точек)
    x_levels = [x for x,_ in V]
    y_levels = [y for _,y in V]
    if splitters_in:
        for g in splitters_in:
            if isinstance(g, Curve):
                x1,y1,_=to_local_point(g.StartPoint, cs); x2,y2,_=to_local_point(g.EndPoint, cs)
                if abs(x1-x2)<1e-6 and abs(y1-y2)<1e-6:
                    x_levels.append(x1); y_levels.append(y1)
                else:
                    if abs(x1-x2)<1e-6: x_levels.append(x1)
                    if abs(y1-y2)<1e-6: y_levels.append(y1)
            elif isinstance(g, Point):
                x,y,_=to_local_point(g, cs); x_levels.append(x); y_levels.append(y)

    x_levels = uniq_sorted(x_levels, EPS)
    y_levels = uniq_sorted(y_levels, EPS)

    # генерим зоны
    zones=[]
    for yi in range(len(y_levels)-1):
        y0,y1 = y_levels[yi], y_levels[yi+1]
        for xi in range(len(x_levels)-1):
            x0,x1 = x_levels[xi], x_levels[xi+1]
            if rect_inside_strict(x0,y0,x1,y1, V):
                bl=Point.ByCartesianCoordinates(cs,x0,y0,0)
                br=Point.ByCartesianCoordinates(cs,x1,y0,0)
                tr=Point.ByCartesianCoordinates(cs,x1,y1,0)
                tl=Point.ByCartesianCoordinates(cs,x0,y1,0)
                zones.append(PolyCurve.ByPoints([bl,br,tr,tl,bl]))

    OUT = zones
# ----------------------------------------

# group: Get Placement from Level
code_block_5 = CodeBlock { "ILevelObject"; }
getInterfaceByName_2 = DynRenga.RengaAPI.IModelObject.GetInterfaceByName(iModelObject=getById, interfaceName=code_block_5)
getPlacement = DynRenga.RengaAPI.ILevelObject.GetPlacement(iLevelObject=getInterfaceByName_2)

placement3DToCoordinateSystem = DynRenga.Converters.Renga.PlacementConverter.Placement3DToCoordinateSystem(placement=getPlacement)
transform = Geometry.Transform(geometry=code_block_3, cs=placement3DToCoordinateSystem, lacing=Longest)
color_palette = ColorPalette({R: 0, G: 204, B: 5, A: 255})
byGeometryColor = Modifiers.GeometryColor.ByGeometryColor(geometry=transform, color=color_palette)
color_palette_2 = ColorPalette({R: 255, G: 0, B: 0, A: 255})
byGeometryColor_2 = Modifiers.GeometryColor.ByGeometryColor(geometry=code_block_4, color=color_palette_2)
byPatch = Surface.ByPatch(closedCurve=python_script_2)

# group: CoreNodeModels.ColorRange
# Inserted Dynamo graph
code_block_6 = CodeBlock(input=byPatch) { input; }
color_palette_3 = ColorPalette({R: 255, G: 127, B: 1, A: 255})
color_palette_4 = ColorPalette({R: 190, G: 254, B: 5, A: 255})
color_palette_5 = ColorPalette({R: 0, G: 254, B: 1, A: 255})
color_palette_6 = ColorPalette({R: 0, G: 255, B: 255, A: 255})
list_create = List.Create(item0=color_palette_3, item1=color_palette_4, item2=color_palette_5, item3=color_palette_6)
code_block_7 = CodeBlock(c=list_create) { 0..1..#List.Count(c); }
code_block_8 = CodeBlock(c=code_block_6) { 0..1..#List.Count(c); }
color_range = ColorRange(colors=list_create, indices=code_block_7, value=code_block_8)
code_block_9 = CodeBlock(t1=color_range)
# ---------- code_block_9.designscript (6 lines) ----------
t2 = DSCore.Color.Components(t1);
t3 = Dictionary.ValueAtKey(t2, "alpha");
t4 = Dictionary.ValueAtKey(t2, "red");
t5 = Dictionary.ValueAtKey(t2, "green");
t6 = Dictionary.ValueAtKey(t2, "blue");
color1 = DSCore.Color.ByARGB(50, t4, t5, t6);
# ----------------------------------------
byGeometryColor_3 = Modifiers.GeometryColor.ByGeometryColor(geometry=code_block_6, color=code_block_9.color1)

# group: Получение светильников > Получение объектов
getAllObjectTypes = DynRenga.RengaAPI.Constants.ObjectTypes.GetAllObjectTypes()
code_block_10 = CodeBlock { "LightingFixture"; }
valueAtKey = DesignScript.Builtin.Dictionary.ValueAtKey(dictionary=getAllObjectTypes.ObjectTypes, key=code_block_10)
getObjectsByType = DynRenga.RengaAPI.IModelObjectCollection.GetObjectsByType(iModelObjectCollection=getObjects, objectType=valueAtKey)
id = DynRenga.RengaAPI.IModelObject.Id(iModelObject=getObjectsByType)

# group: Получение светильников
getParameters = DynRenga.RengaAPI.IModelObject.GetParameters(iModelObject=getObjectsByType)
getAllParameters = DynRenga.RengaAPI.IParameterContainer.GetAllParameters(iParameterContainer=getParameters)
definition = DynRenga.RengaAPI.IParameter.Definition(iParameter=getAllParameters)
name = DynRenga.RengaAPI.IParameterDefinition.Name(iParameterDefinition=definition)
text = DynRenga.RengaAPI.IParameterDefinition.Text(iParameterDefinition=definition)
getQuantities = DynRenga.RengaAPI.IModelObject.GetQuantities(iModelObject=getObjectsByType)
project = DynRenga.RengaAPI.IApplication.Project(iApplication=IApplication)
IDataExporter = DynRenga.RengaAPI.IDataExporter.IDataExporter(project=project)
getObjects3D = DynRenga.RengaAPI.IDataExporter.GetObjects3D(iDataExporter=IDataExporter)
getAllObjects = DynRenga.RengaAPI.IExportedObject3DCollection.GetAllObjects(iExportedObject3DCollection=getObjects3D)
getObjectsByModelObjectId = DynRenga.RengaAPI.IExportedObject3DCollection.GetObjectsByModelObjectId(iExportedObject3DCollection=getObjects3D, modelObjectId=id)
exportedObjectToBoundingBox = DynRenga.Converters.Renga.MeshConverter.ExportedObjectToBoundingBox(exported=getObjectsByModelObjectId)
toCuboid = BoundingBox.ToCuboid(boundingBox=exportedObjectToBoundingBox)
exportedObjectToDynamoGeometry = DynRenga.Converters.Renga.MeshConverter.ExportedObjectToDynamoGeometry(exported=getObjectsByModelObjectId)
code_block_11 = CodeBlock { 50; }
color_palette_7 = ColorPalette({R: 255, G: 0, B: 73, A: 255})
components = Color.Components(color=color_palette_7)
byARGB = Color.ByARGB(alpha=code_block_11, red=components.red, green=components.green, blue=components.blue)
byMeshColors = Modifiers.GeometryColor.ByMeshColors(mesh=exportedObjectToDynamoGeometry.Meshes, colors=byARGB)
vertexPositions = Mesh.VertexPositions(mesh=exportedObjectToDynamoGeometry.Meshes)
byBestFitThroughPoints = Line.ByBestFitThroughPoints(bestFitPoints=vertexPositions)
code_block_12 = CodeBlock { 0.5; }
byBestFitThroughPoints_2 = Circle.ByBestFitThroughPoints(points=vertexPositions)

# group: Получение светильников > Выбор точек
centroid = Solid.Centroid(solid=toCuboid)
pointAtParameter = Curve.PointAtParameter(curve=byBestFitThroughPoints, param=code_block_12)
centerPoint = Circle.CenterPoint(circle=byBestFitThroughPoints_2)
code_block_13 = CodeBlock(choice=centerPoint) { choice; }

# group: Находим и разделям зоны со светильниками и без
code_block_14 = CodeBlock(cs=placement3DToCoordinateSystem, zones=python_script_2, points=code_block_13) { cs; zones; points; }
code_block_15 = CodeBlock(input=code_block_14.zones) { input; }
byPatch_2 = Surface.ByPatch(closedCurve=code_block_15)
inverse = CoordinateSystem.Inverse(coordinateSystem=code_block_14.cs)
transform_2 = Geometry.Transform(geometry=code_block_14.points, cs=inverse, lacing=Longest)
Z = Point.Z(point=transform_2)
code_block_16 = CodeBlock(x=Z) { -x; }
translate = Geometry.Translate(geometry=transform_2, zTranslation=code_block_16)
flatten = List.Flatten(list=translate)
doesIntersect = Geometry.DoesIntersect(geometry=byPatch_2, other=flatten, lacing=CrossProduct)
anyTrue = List.AnyTrue(list=doesIntersect, lacing=Longest)
filterByBoolMask = List.FilterByBoolMask(list=code_block_15, mask=anyTrue)
code_block_17 = CodeBlock(has_points=filterByBoolMask.in, no_points=filterByBoolMask.out) { has_points; no_points; }
countTrue = List.CountTrue(list=doesIntersect, lacing=Longest)
filterByBoolMask_2 = List.FilterByBoolMask(list=countTrue, mask=anyTrue)
code_block_18 = CodeBlock(has_points=filterByBoolMask_2.in, no_points=filterByBoolMask_2.out) { has_points; no_points; }

# group: Поиск смежный внутри списка
code_block_19 = CodeBlock(input1=code_block_15) { input1; }
code_block_20 = CodeBlock { 0.01; }
python_script_3 = Python(IN[0]=code_block_19, IN[1]=code_block_20)  # CPython3
# ---------- python_script_3.python (323 lines) ----------
"""
Dynamo Python (IronPython 2.7) script: find_rectangle_neighbors_dynamo.py

Inputs (Dynamo Python node):
    polycurves: list of Dynamo PolyCurve (each rectangle as closed polycurve)
    tol: float tolerance for geometric comparisons (default 1e-6)

Output (Dynamo Python node):
    neighbors_by_index: list of lists, where each inner list contains indices of polycurves
                        that touch the polycurve at one or more side edges.

Notes:
- This script uses only Dynamo geometry objects and basic math; it should run inside
  Dynamo's IronPython 2.7 environment (no external packages required).
- The script assumes rectangles are closed PolyCurves composed of 4 contiguous line segments.
- The neighbor test between two rectangles checks each segment pair for:
    1) collinearity (within tolerance)
    2) 1D overlap of the projected segment intervals (within tolerance)
    3) not just touching at a corner (overlap length > tol) unless you want to include corner-only contacts.

Usage in Dynamo Python node:
- Inputs:
    IN[0] -> polycurves
    IN[1] -> tol
- Output:
    OUT -> neighbors_by_index

Example:
    rectangles = [rectA, rectB, rectC]
    tol = 1e-6
    neighbors_by_index = find_neighbors(rectangles, tol)

Return format example:
    [[1], [0,2], [1]]  # rect 0 neighbors: [1]; rect1 neighbors: [0,2]; rect2: [1]

Author: Generated for user
"""

import math

# Dynamo geometry helpers: to keep compatibility with IronPython without explicit imports
# we will assume the incoming objects behave like Dynamo Geometry PolyCurve and Line objects.

# Helper: compare floats
def is_close(a, b, tol):
    return abs(a - b) <= tol

# Convert a Dynamo line to a tuple of start/end points (each point has X,Y,Z attributes)
def line_endpoints(line):
    # Dynamo Line has .StartPoint and .EndPoint or .Start and .End depending on version
    try:
        a = line.StartPoint
        b = line.EndPoint
    except Exception:
        a = line.Start
        b = line.End
    return a, b

# Vector utilities (points/vectors have .X, .Y, .Z)
def vec_sub(a, b):
    return (a.X - b.X, a.Y - b.Y, a.Z - b.Z)

def dot(u, v):
    return u[0]*v[0] + u[1]*v[1] + u[2]*v[2]

def cross(u, v):
    return (u[1]*v[2] - u[2]*v[1], u[2]*v[0] - u[0]*v[2], u[0]*v[1] - u[1]*v[0])

def length(v):
    return math.sqrt(dot(v, v))

# Check if two 3D vectors are collinear within tol: cross product magnitude small and direction aligned
def are_collinear(u, v, tol):
    c = cross(u, v)
    return length(c) <= tol * max(1.0, length(u), length(v))

# Project a point onto a line defined by origin O and direction D (D does not need to be unit)
# returns scalar parameter t where P = O + t*D
def project_param(O, D, P):
    OP = vec_sub(P, O)
    denom = dot(D, D)
    if denom == 0:
        return 0.0
    return dot(OP, D) / denom

# Check 1D overlap between intervals [a0,a1] and [b0,b1] with tolerance
# Returns overlap length (>= 0)
def interval_overlap(a0, a1, b0, b1, tol):
    if a1 < a0:
        a0, a1 = a1, a0
    if b1 < b0:
        b0, b1 = b1, b0
    lo = max(a0, b0)
    hi = min(a1, b1)
    ov = hi - lo
    if ov <= tol:
        return 0.0
    return ov

# Given two Dynamo Line segments, check if they lie on the same infinite line (collinear) and overlap
# Returns True if they overlap by more than tol (i.e., share a side), False otherwise
def segments_touch_by_side(line1, line2, tol):
    a1, a2 = line_endpoints(line1)
    b1, b2 = line_endpoints(line2)
    u = vec_sub(a2, a1)
    v = vec_sub(b2, b1)

    if length(u) < tol or length(v) < tol:
        return False
# Dynamo / IronPython 2.7 script
# Purpose: Given a list of Dynamo PolyCurves (rectangles), return for each polycurve
# the list of neighbor indices that share an edge with it. Corner-only touches are
# excluded (i.e., touching at a single point does not count as a neighbor).
#
# Inputs:
#   IN[0] -> curves : list of PolyCurve (Dynamo geometry)
#   IN[1] -> tol : float (optional) - distance tolerance for geometric checks (default 1e-6)
#
# Output:
#   OUT -> neighbors_by_index : list of lists of indices
#
# Usage notes:
# - Wire your list of closed PolyCurves (rectangles) into IN[0].
# - Optionally wire a small tolerance (meters or model units) into IN[1].
# - The script will only treat two polycurves as neighbors if they have a
#   non-zero overlapping edge (overlap length > tol). If they only touch at
#   a corner point, they are NOT considered neighbors.
#
# Example (conceptual):
# - Rect A and Rect B share a full side -> A neighbors include B and vice versa.
# - Rect C touches Rect A only at a single corner -> not a neighbor.
# Expected output for [A,B,C] would be something like: [[1],[0],[]]
#
# Concrete conceptual layout (indices):
# 0: Rect A at origin spanning (0,0)-(2,1)
# 1: Rect B to the right of A spanning (2,0)-(4,1)  # shares vertical edge x=2 with A -> edge-touch
# 2: Rect C above A spanning (2,1)-(3,2)            # touches A only at corner (2,1) -> NOT neighbor
#
# Expected neighbors: [[1], [0], []]

import clr
import System
from System import Array

# Dynamo geometry types
clr.AddReference('ProtoGeometry')
from Autodesk.DesignScript.Geometry import Point, Vector, CoordinateSystem

# Helper math
import math

def is_zero(val, tol):
    return abs(val) <= tol

def are_vectors_collinear(v1, v2, tol_angle):
    # Check if v1 and v2 are collinear (parallel or anti-parallel) within tol_angle (radians)
    cross_x = v1.Y * v2.Z - v1.Z * v2.Y
    cross_y = v1.Z * v2.X - v1.X * v2.Z
    cross_z = v1.X * v2.Y - v1.Y * v2.X
    cross_mag = math.sqrt(cross_x*cross_x + cross_y*cross_y + cross_z*cross_z)
    denom = v1.Length * v2.Length
    if is_zero(denom, 1e-12):
        return False
    sin_theta = cross_mag / denom
    theta = math.asin(min(1.0, max(-1.0, sin_theta)))
    return abs(theta) <= tol_angle

def project_point_onto_line_param(pt, line_p0, dir_vec):
    # Parametric projection t such that projection = line_p0 + t * dir_vec
    dx = pt.X - line_p0.X
    dy = pt.Y - line_p0.Y
    dz = pt.Z - line_p0.Z
    dot1 = dx * dir_vec.X + dy * dir_vec.Y + dz * dir_vec.Z
    dot2 = dir_vec.X * dir_vec.X + dir_vec.Y * dir_vec.Y + dir_vec.Z * dir_vec.Z
    if is_zero(dot2, 1e-12):
        return None
    return dot1 / dot2

def perp_distance_point_to_line(pt, line_p0, dir_vec, dir_len):
    # Perpendicular distance from pt to infinite line defined by (line_p0, dir_vec)
    vx = pt.X - line_p0.X
    vy = pt.Y - line_p0.Y
    vz = pt.Z - line_p0.Z
    cross_x = vy * dir_vec.Z - vz * dir_vec.Y
    cross_y = vz * dir_vec.X - vx * dir_vec.Z
    cross_z = vx * dir_vec.Y - vy * dir_vec.X
    cross_mag = math.sqrt(cross_x*cross_x + cross_y*cross_y + cross_z*cross_z)
    if is_zero(dir_len, 1e-12):
        return float('inf')
    return cross_mag / dir_len

# Main algorithm
# Support inputs:
# IN[0] -> listA : list of PolyCurves (rectangles) to find neighbors for
# IN[1] -> listB or tol : if this is a list, it's treated as listB to compare against listA.
#                           if it's a number or None, it's treated as tol and we compare within listA.
# IN[2] -> tol : optional tolerance when IN[1] is listB

# Dynamo provides IN when running inside a Dynamo Python node. Use a safe fallback
# to avoid NameError during static analysis or local runs.
IN = globals().get('IN', [None, None, None])

listA = IN[0] if len(IN) > 0 else None
second = IN[1] if len(IN) > 1 else None
third = IN[2] if len(IN) > 2 else None

# Optional: when run as a normal Python script, allow a tiny demo (no Dynamo geometry)
if __name__ == '__main__':
    print('Running find_rectangle_neighbors_dynamo.py as standalone - no demo available for Dynamo geometry')

# Determine whether second is a list of curves or a numeric tolerance
def is_iterable(obj):
    try:
        iter(obj)
        return True
    except Exception:
        return False

if listA is None:
    OUT = []
else:
    # Decide inputs
    if second is None or (not is_iterable(second)) or isinstance(second, (float, int)):
        # single-list mode: compare within listA
        listB = listA
        tol = float(second) if second is not None else (float(third) if third is not None else 1e-6)
        symmetric = True
    else:
        # two-list mode: compare listA against listB (no symmetry)
        listB = second
        tol = float(third) if third is not None else 1e-6
        symmetric = False

    # Pre-extract segments for each polycurve in both lists
    def extract_segments(curves):
        segs_list = []
        for c in curves:
            try:
                segs = list(c.Curves())
            except Exception:
                segs = [c]
            segs_list.append(segs)
        return segs_list

    segsA = extract_segments(listA)
    segsB = extract_segments(listB)

    nA = len(listA)
    nB = len(listB)

    # Initialize neighbor lists for items in A (indices refer to listB indices)
    neighbors = [[] for _ in range(nA)]

    # Small angle tolerance for collinearity (radians)
    angle_tol = 1e-6

    for i in range(nA):
        segs_i = segsA[i]
        # Depending on symmetric mode we may avoid double-checking pairs
        j_start = 0
        for j in range(j_start, nB):
            # If symmetric and comparing listA to itself, avoid duplicate pairs and self
            if symmetric and j <= i:
                continue

            segs_j = segsB[j]
            touches = False

            # Compare each segment pair
            for si in segs_i:
                a0 = si.StartPoint
                a1 = si.EndPoint
                dir_i = Vector.ByTwoPoints(a0, a1)
                # precompute denom and length
                denom_len2 = dir_i.X*dir_i.X + dir_i.Y*dir_i.Y + dir_i.Z*dir_i.Z
                if is_zero(denom_len2, 1e-12):
                    continue
                dir_len = math.sqrt(denom_len2)

                for sj in segs_j:
                    b0 = sj.StartPoint
                    b1 = sj.EndPoint
                    dir_j = Vector.ByTwoPoints(b0, b1)

                    # Check collinearity of directions
                    if not are_vectors_collinear(dir_i, dir_j, angle_tol):
                        continue

                    # Project endpoints of sj onto line of si (parametric t where a0->0, a1->1)
                    tb0 = project_point_onto_line_param(b0, a0, dir_i)
                    tb1 = project_point_onto_line_param(b1, a0, dir_i)
                    if tb0 is None or tb1 is None:
                        continue

                    bmin = min(tb0, tb1)
                    bmax = max(tb0, tb1)

                    # Overlap between [0,1] and [bmin,bmax] in param units
                    overlap_param = min(1.0, bmax) - max(0.0, bmin)
                    # Convert overlap to absolute length along segment i
                    overlap_length = overlap_param * dir_len

                    # Require a positive overlapping edge longer than tol (not just a point)
                    if overlap_length <= tol:
                        # Too small or zero -> likely corner-only or gap
                        continue

                    # Ensure the other segment's endpoints are close to the line (within tol)
                    pd0 = perp_distance_point_to_line(b0, a0, dir_i, dir_len)
                    pd1 = perp_distance_point_to_line(b1, a0, dir_i, dir_len)
                    if pd0 <= tol + 1e-9 and pd1 <= tol + 1e-9:
                        touches = True
                        break
                if touches:
                    break

            if touches:
                neighbors[i].append(j)
                # If symmetric (same list) also append reverse
                if symmetric:
                    neighbors[j].append(i)

    OUT = neighbors
# ----------------------------------------
getItemAtIndex = List.GetItemAtIndex(list=code_block_19, index=python_script_3)

filterByBoolMask_3 = List.FilterByBoolMask(list=getItemAtIndex, mask=anyTrue)
byPatch_3 = Surface.ByPatch(closedCurve=code_block_17.no_points)
color_palette_8 = ColorPalette({R: 255, G: 0, B: 0, A: 255})
byGeometryColor_4 = Modifiers.GeometryColor.ByGeometryColor(geometry=byPatch_3, color=color_palette_8)
integer_slider = IntegerSlider(2, range=0..10 step 1)
code_block_21 = CodeBlock(a=byGeometryColor_4, b=integer_slider) { a[b]; }

# group: Поиск смежных между двумя списками
code_block_22 = CodeBlock(input1=code_block_17.has_points, input2=code_block_17.no_points) { input1; input2; }
python_script_4 = Python(IN[0]=code_block_22.input2, IN[1]=code_block_22.input1)  # CPython3; same code as python_script_3
getItemAtIndex_2 = List.GetItemAtIndex(list=code_block_22.input1, index=python_script_4)

getItemAtIndex_3 = List.GetItemAtIndex(list=code_block_18.has_points, index=python_script_4)
code_block_23 = CodeBlock(a=getItemAtIndex_3, b=integer_slider) { a[b]; }
code_block_24 = CodeBlock(a=code_block_23) { a; }
code_block_25 = CodeBlock(a=code_block_17.no_points, b=integer_slider) { a[b]; }
code_block_26 = CodeBlock(a=getItemAtIndex_2, b=integer_slider) { a[b]; }

# group: Объединение
curves = PolyCurve.Curves(polyCurve=code_block_25)
python_script_5 = Python(IN[0]=code_block_26, IN[1]=curves)  # CPython3; same code as python_script_3
flatten_2 = List.Flatten(list=python_script_5)
getItemAtIndex_4 = List.GetItemAtIndex(list=curves, index=flatten_2)
length = Curve.Length(curve=getItemAtIndex_4)
code_block_27 = CodeBlock(out=code_block_25) { out; }
code_block_28 = CodeBlock {  }

maximumItem = List.MaximumItem(list=length)
eq = length == maximumItem
filterByBoolMask_4 = List.FilterByBoolMask(list=code_block_24, mask=eq)

# group: Если равное количество
maximumItem_2 = List.MaximumItem(list=filterByBoolMask_4.in)
eq_2 = filterByBoolMask_4.in == maximumItem_2
countTrue_2 = List.CountTrue(list=eq_2)
code_block_29 = CodeBlock { 1; }
gt = countTrue_2 > code_block_29

code_block_30 = CodeBlock(main=code_block_25) { main; }
python_script_6 = Python(IN[0]=code_block_30)  # CPython3
# ---------- python_script_6.python (157 lines) ----------
# Dynamo Python script
# Split a closed polycurve (polygon) into two polygons of equal area.
# The split line is parallel to the longest polygon edge.
# Inputs:
#   IN[0] : polygon (Autodesk.DesignScript Geometry Polygon / PolyCurve) or list of points
# Output:
#   OUT[0] : polygon A (Dynamo Polygon)
#   OUT[1] : polygon B (Dynamo Polygon)

import clr
clr.AddReference('ProtoGeometry')
from Autodesk.DesignScript.Geometry import Point, Polygon, PolyCurve

# read input
src = IN[0]

# helpers to extract 2D point tuples from several possible input shapes
def to_point_list(obj):
    # if it's already a list of Dynamo Points
    try:
        if isinstance(obj, list) and len(obj)>0 and hasattr(obj[0], 'X'):
            return [(p.X, p.Y) for p in obj]
    except:
        pass
    # if it's a Dynamo Polygon or PolyCurve with Vertices/Points
    try:
        pts = []
        if hasattr(obj, "Vertices"):
            for v in obj.Vertices:
                pts.append((v.X, v.Y))
            return pts
        if hasattr(obj, "Points"):
            for v in obj.Points:
                pts.append((v.X, v.Y))
            return pts
    except:
        pass
    # maybe it's a single curve exposing Coordinates
    try:
        if hasattr(obj, "Coordinates"):
            return [(c.X, c.Y) for c in obj.Coordinates]
    except:
        pass
    # fallback: if given as list of tuples already
    if isinstance(obj, list) and len(obj)>0 and isinstance(obj[0], (tuple, list)):
        return [(float(x), float(y)) for x,y in obj]
    return None

pts = to_point_list(src)
if not pts or len(pts) < 3:
    OUT = [src, None]
else:
    # ensure polygon is closed (last != first)
    if pts[0] != pts[-1]:
        pts = pts[:]
        pts.append(pts[0])

    # vector helpers
    def sub(a,b): return (a[0]-b[0], a[1]-b[1])
    def add(a,b): return (a[0]+b[0], a[1]+b[1])
    def mul(a,s): return (a[0]*s, a[1]*s)
    def dot(a,b): return a[0]*b[0] + a[1]*b[1]
    def length(a): 
        import math
        return math.hypot(a[0], a[1])

    # find longest edge direction
    maxlen = -1.0
    maxdir = (1.0, 0.0)
    for i in range(len(pts)-1):
        a = pts[i]
        b = pts[i+1]
        v = sub(b,a)
        l = length(v)
        if l > maxlen:
            maxlen = l
            if l > 0:
                maxdir = (v[0]/l, v[1]/l)

    # unit direction parallel to longest edge
    v = maxdir
    # normal direction (perpendicular) we will move along to place the cut
    n = (-v[1], v[0])

    # polygon area (shoelace), expects closed polygon (last repeats first)
    def polygon_area(poly):
        a = 0.0
        for i in range(len(poly)-1):
            x1,y1 = poly[i]
            x2,y2 = poly[i+1]
            a += x1*y2 - x2*y1
        return abs(a) * 0.5

    total_area = polygon_area(pts)

    # clip polygon to half-space defined by n·p <= t (Sutherland-Hodgman)
    def clip_halfspace(poly, nvec, t):
        res = []
        for i in range(len(poly)-1):
            P = poly[i]
            Q = poly[i+1]
            dP = dot(nvec, P) - t
            dQ = dot(nvec, Q) - t
            # if P inside, include
            if dP <= 0:
                res.append(P)
            # edge crosses boundary?
            if dP * dQ < 0:
                # compute intersection
                s = dP / (dP - dQ)
                inter = add(P, mul(sub(Q,P), s))
                res.append(inter)
        # close if not empty
        if len(res) > 0 and res[0] != res[-1]:
            res.append(res[0])
        return res

    # compute projection min/max for search range
    projs = [dot(n, p) for p in pts[:-1]]
    pmin = min(projs) - 1e-6
    pmax = max(projs) + 1e-6

    # bisection search for t where left area approx equals half
    target = total_area * 0.5
    lo = pmin
    hi = pmax
    t = (lo + hi) / 2.0
    for _ in range(60):
        t = (lo + hi) / 2.0
        left_poly = clip_halfspace(pts, n, t)
        a_left = polygon_area(left_poly) if len(left_poly) >= 4 else 0.0
        if a_left > target:
            hi = t
        else:
            lo = t

    t = (lo + hi) / 2.0
    polyA_pts = clip_halfspace(pts, n, t)       # n·p <= t
    # other half: clip by opposite half-space (n·p >= t) => clip with -n and -t for <= form
    negn = (-n[0], -n[1])
    polyB_pts = clip_halfspace(pts, negn, -t)

    # construct Dynamo polygons (Polygon.ByPoints expects list of Point)
    def make_polycurve_from_xy(xylist):
        if not xylist or len(xylist) < 4:
            return None
        points = [Point.ByCoordinates(x,y,0) for x,y in xylist[:-1]]  # exclude duplicated last
        try:
            return PolyCurve.ByPoints(points)
        except:
            # fallback to polycurve via creating closed point list
            return PolyCurve.ByPoints(points)

    polyA = make_polycurve_from_xy(polyA_pts)
    polyB = make_polycurve_from_xy(polyB_pts)

    OUT = [polyA, polyB]
# ----------------------------------------
closeWithLine = PolyCurve.CloseWithLine(polyCurve=python_script_6)
if_ = RefactoredIf(test=gt, true=closeWithLine, false=code_block_27)
countTrue_3 = List.CountTrue(list=eq)
code_block_31 = CodeBlock { 1; }
gt_2 = countTrue_3 > code_block_31
code_block_32 = CodeBlock(a=code_block_26) { a; }
filterByBoolMask_5 = List.FilterByBoolMask(list=code_block_32, mask=eq)

# group: Примыкает к той что с меньшей площадью
code_block_33 = CodeBlock(a=filterByBoolMask_5.in) { a; }
byPatch_4 = Surface.ByPatch(closedCurve=code_block_33)
area = Surface.Area(surface=byPatch_4)
minimumItem = List.MinimumItem(list=area)
indexOf = List.IndexOf(list=area, element=minimumItem)
getItemAtIndex_5 = List.GetItemAtIndex(list=code_block_33, index=indexOf)

if_2 = RefactoredIf(test=gt, true=code_block_33, false=getItemAtIndex_5)

# group: Поиск смежный внутри списка
code_block_34 = CodeBlock(input1=code_block_17.no_points) { input1; }
code_block_35 = CodeBlock { 0.01; }
python_script_7 = Python(IN[0]=code_block_34, IN[1]=code_block_35)  # CPython3; same code as python_script_3
getItemAtIndex_6 = List.GetItemAtIndex(list=code_block_34, index=python_script_7)

code_block_36 = CodeBlock { null; }

# group (continued): Объединение
indexOf_2 = List.IndexOf(list=length, element=maximumItem)
getItemAtIndex_7 = List.GetItemAtIndex(list=code_block_26, index=indexOf_2)

# group: Если больше 1го красного
code_block_37 = CodeBlock(a=getItemAtIndex_6, b=integer_slider) { a[b]; }
count = List.Count(list=code_block_37)
code_block_38 = CodeBlock { 1; }
gt_3 = count > code_block_38
if_3 = RefactoredIf(test=gt_3, true=code_block_36, false=getItemAtIndex_7)

if_4 = RefactoredIf(test=gt_2, true=if_2, false=if_3)

# group (continued): Объединение
list_create_2 = List.Create(item0=if_, item1=if_4)

transpose = List.Transpose(lists=list_create_2)

# group (continued): Объединение
byPatch_5 = Surface.ByPatch(closedCurve=transpose)
byUnion = Surface.ByUnion(surfaces=byPatch_5)
perimeterCurves = Surface.PerimeterCurves(surface=byUnion)
byJoinedCurves = PolyCurve.ByJoinedCurves(curves=perimeterCurves)

color_palette_9 = ColorPalette({R: 255, G: 0, B: 0, A: 255})
byGeometryColor_5 = Modifiers.GeometryColor.ByGeometryColor(geometry=getItemAtIndex_6, color=color_palette_9)
code_block_39 = CodeBlock(a=byGeometryColor_5, b=integer_slider) { a[b]; }
color_palette_10 = ColorPalette({R: 0, G: 128, B: 254, A: 255})
byGeometryColor_6 = Modifiers.GeometryColor.ByGeometryColor(geometry=perimeterCurves, color=color_palette_10)
code_block_40 = CodeBlock {  }
if_5 = RefactoredIf(test=gt, true=code_block_36, false=getItemAtIndex_5)
code_block_41 = CodeBlock { 100; }
components_2 = Color.Components(color=color_palette_8)
byARGB_2 = Color.ByARGB(alpha=code_block_41, red=components_2.red, green=components_2.green, blue=components_2.blue)
code_block_42 = CodeBlock { 200; }
color_palette_11 = ColorPalette({R: 59, G: 254, B: 5, A: 255})
components_3 = Color.Components(color=color_palette_11)
byARGB_3 = Color.ByARGB(alpha=code_block_42, red=components_3.red, green=components_3.green, blue=components_3.blue)
byGeometryColor_7 = Modifiers.GeometryColor.ByGeometryColor(geometry=code_block_26, color=byARGB_3)
