# Dynamo graph Zones2.dyn (Dynamo 4.0.0.2330)

# group: Подготовка и выбор Ренги
forceCleanup = DynRenga.DynDocument.Application.ForceCleanup()
getRunningRengaInstances = DynRenga.DynDocument.Application.GetRunningRengaInstances()
getRengaInstanceList = DynRenga.DynDocument.Application.GetRengaInstanceList()
code_block = CodeBlock { 0; }
IApplication = DynRenga.RengaAPI.IApplication.IApplication(instanceIndex=code_block)

# group: Получение выделенного объекта
IModel = DynRenga.RengaAPI.IModel.IModel(application=IApplication)
getObjects = DynRenga.RengaAPI.IModel.GetObjects(iModel=IModel)
ISelection = DynRenga.RengaAPI.ISelection.ISelection(application=IApplication)
getSelectedObjects = DynRenga.RengaAPI.ISelection.GetSelectedObjects(iSelection=ISelection)
getById = DynRenga.RengaAPI.IModelObjectCollection.GetById(iModelObjectCollection=getObjects, id=getSelectedObjects)

# group: Получение контура
code_block_2 = CodeBlock { "IBaseline2DObject"; }
getInterfaceByName = DynRenga.RengaAPI.IModelObject.GetInterfaceByName(iModelObject=getById, interfaceName=code_block_2)
getBaseline = DynRenga.RengaAPI.IBaseline2DObject.GetBaseline(iBaseline2DObject=getInterfaceByName)

# group: Деление контура на сегменты
toDynamoPolyCurveOptimized = DynRenga.Converters.Renga.Curve2DConverter.ToDynamoPolyCurveOptimized(curve2D=getBaseline)
code_block_3 = CodeBlock(a=toDynamoPolyCurveOptimized) { a[0]; }
python_script = Python(IN[0]=toDynamoPolyCurveOptimized)  # CPython3
# ---------- python_script.python (204 lines) ----------
import clr
clr.AddReference('ProtoGeometry')
from Autodesk.DesignScript.Geometry import *

B_IN = IN[0]
SPLITTERS_IN = IN[1] if len(IN) > 1 and IN[1] is not None else []
EXT = 0.0
EPS = 1e-6

def flatten(lst):
    out = []
    for x in lst if isinstance(lst, (list, tuple)) else [lst]:
        if isinstance(x, (list, tuple)):
            out.extend(flatten(x))
        else:
            out.append(x)
    return out

def to_polycurve_loose(g):
    if isinstance(g, PolyCurve):
        try:
            return PolyCurve.ByJoinedCurves(g.Curves())
        except:
            return g
    if isinstance(g, Polygon):
        return PolyCurve.ByJoinedCurves(list(g.Curves()))
    if isinstance(g, Surface):
        try:
            return PolyCurve.ByJoinedCurves(g.PerimeterCurves())
        except:
            pass
    if isinstance(g, Curve):
        return PolyCurve.ByJoinedCurves([g])
    if isinstance(g, (list, tuple)):
        cs = [c for c in flatten(g) if isinstance(c, Curve)]
        if cs:
            return PolyCurve.ByJoinedCurves(cs)
    return None

def uniq(vals, tol=1e-6):
    vs = sorted(vals)
    out = []
    for v in vs:
        if not out or abs(v - out[-1]) > tol:
            out.append(v)
    return out

def bbox_of_polycurve(pc):
    try:
        return pc.BoundingBox
    except:
        minx=miny=1e99; maxx=maxy=-1e99
        for c in pc.Curves():
            for p in [c.StartPoint, c.EndPoint]:
                minx=min(minx,p.X); maxx=max(maxx,p.X)
                miny=min(miny,p.Y); maxy=max(maxy,p.Y)
        return BoundingBox.ByCorners(Point.ByCoordinates(minx,miny,0), Point.ByCoordinates(maxx,maxy,0))

def collect_vertices(pc):
    pts = []
    try:
        pts = pc.Points()
    except:
        for c in pc.Curves():
            try:
                pts.append(c.StartPoint)
            except:
                pass
        try:
            pts.append(pc.Curves()[-1].EndPoint)
        except:
            pass
    return pts

def point_in_polygon(px, py, verts, eps=1e-9):
    inside = False
    n = len(verts)
    if n < 3: return False
    py_adj = py - eps
    for i in range(n-1):
        x1,y1 = verts[i]; x2,y2 = verts[i+1]
        if abs(y1-y2) <= eps:
            if min(x1,x2)-eps <= px <= max(x1,x2)+eps and abs(py - y1) <= eps:
                return True
            continue
        ymin = min(y1,y2); ymax = max(y1,y2)
        if not (ymin - eps <= py_adj < ymax - eps): continue
        xint = (x2-x1)*(py_adj - y1)/(y2-y1) + x1
        if abs(px - xint) <= eps: return True
        if px < xint: inside = not inside
    return inside

def is_horizontal(line, tol=1e-6):
    return abs(line.StartPoint.Y - line.EndPoint.Y) < tol

def is_vertical(line, tol=1e-6):
    return abs(line.StartPoint.X - line.EndPoint.X) < tol

DEBUG = {"steps": []}
def log(m): DEBUG["steps"].append(str(m))

pc = to_polycurve_loose(B_IN)
if pc is None:
    OUT = [[], {"error":"Could not interpret IN[0] as curves/polycurve", "steps": DEBUG["steps"]}]
else:
    # Get boundary info
    is_closed = getattr(pc, "IsClosed", None)
    crv_count = len(pc.Curves()) if hasattr(pc, "Curves") else None
    log("PolyCurve built. IsClosed=%s, Curves=%s" % (str(is_closed), str(crv_count)))

    # Get boundary vertices
    pts = collect_vertices(pc)
    Xs = [p.X for p in pts]
    Ys = [p.Y for p in pts]
    
    # Get bounding box
    bb = bbox_of_polycurve(pc)
    minp, maxp = bb.MinPoint, bb.MaxPoint
    xmin, xmax = minp.X, maxp.X
    ymin, ymax = minp.Y, maxp.Y

    # Create splitters from input splitters + internal coordinates
    splitters = []
    
    # Add user-provided splitters
    if SPLITTERS_IN:
        user_splitters = flatten(SPLITTERS_IN)
        for ln in user_splitters:
            if isinstance(ln, Curve):
                splitters.append(ln)
    
    # Add internal X coordinates (exclude boundary edges)
    internal_xs = []
    for x in uniq(Xs):
        if x > xmin + EPS and x < xmax - EPS:  # Internal only
            internal_xs.append(x)
    
    # Add internal Y coordinates (exclude boundary edges)  
    internal_ys = []
    for y in uniq(Ys):
        if y > ymin + EPS and y < ymax - EPS:  # Internal only
            internal_ys.append(y)
    
    # Create vertical splitters for internal X coordinates
    for x in internal_xs:
        splitters.append(Line.ByStartPointEndPoint(
            Point.ByCoordinates(x, ymin, 0), 
            Point.ByCoordinates(x, ymax, 0)
        ))
    
    # Create horizontal splitters for internal Y coordinates
    for y in internal_ys:
        splitters.append(Line.ByStartPointEndPoint(
            Point.ByCoordinates(xmin, y, 0), 
            Point.ByCoordinates(xmax, y, 0)
        ))

    # Extract X and Y levels from all splitters
    x_levels = [xmin, xmax]
    y_levels = [ymin, ymax]
    
    for ln in splitters:
        if is_vertical(ln):
            x_levels.append(ln.StartPoint.X)
        elif is_horizontal(ln):
            y_levels.append(ln.StartPoint.Y)
    
    x_levels = uniq(x_levels, EPS)
    y_levels = uniq(y_levels, EPS)
    
    # Get boundary vertices for containment test
    verts = [(p.X, p.Y) for p in pts]
    
    # Create rectangular zones
    zones = []
    for yi in range(len(y_levels)-1):
        y0, y1 = y_levels[yi], y_levels[yi+1]
        for xi in range(len(x_levels)-1):
            x0, x1 = x_levels[xi], x_levels[xi+1]
            
            # Test if rectangle center is inside boundary
            cx, cy = 0.5*(x0+x1), 0.5*(y0+y1)
            if point_in_polygon(cx, cy, verts):
                # Create rectangle
                bl = Point.ByCoordinates(x0, y0, 0)
                br = Point.ByCoordinates(x1, y0, 0)
                tr = Point.ByCoordinates(x1, y1, 0)
                tl = Point.ByCoordinates(x0, y1, 0)
                rect = PolyCurve.ByPoints([bl, br, tr, tl, bl])
                zones.append(rect)

    DEBUG.update({
        "isClosed_reported": is_closed,
        "curve_count": crv_count,
        "vertex_count": len(pts),
        "internal_X": internal_xs,
        "internal_Y": internal_ys,
        "splitters_count": len(splitters),
        "x_levels": x_levels,
        "y_levels": y_levels,
        "zones_created": len(zones)
    })

    OUT = [zones, DEBUG]
# ----------------------------------------
code_block_4 = CodeBlock(a=python_script) { a[0]; }
python_script_2 = Python(IN[0]=code_block_3, IN[1]=code_block_4)  # CPython3
# ---------- python_script_2.python (173 lines) ----------
import clr
clr.AddReference('ProtoGeometry')
from Autodesk.DesignScript.Geometry import *

EPS = 1e-6

def uniq_sorted(vals, tol=1e-6):
    vals = sorted(vals); out = []
    for v in vals:
        if not out or abs(v - out[-1]) > tol: out.append(v)
    return out

def get_local_cs(pc):
    # Нормализация вектора вручную (в некоторых сборках нет Normalize/Normalized)
    def unit(v):
        try:
            L = v.Length
        except:
            # если внезапно пришёл не Vector
            return v
        if L == 0: 
            return v
        return Vector.ByCoordinates(v.X / L, v.Y / L, v.Z / L)

    # 1) пробуем через Surface.ByPatch
    try:
        srf = Surface.ByPatch(pc)
        cs0 = srf.CoordinateSystemAtParameter(0.5, 0.5)
        try: srf.Dispose()
        except: pass
    except:
        # 2) fallback: best-fit plane
        pts = [c.StartPoint for c in pc.Curves()]
        pl = Plane.ByBestFitThroughPoints(pts)
        cs0 = CoordinateSystem.ByPlane(pl)
        for p in pts:
            try: p.Dispose()
            except: pass
        try: pl.Dispose()
        except: pass

    # 3) собираем оси как СВОЙСТВА (не вызываем!)
    o = cs0.Origin
    x = unit(cs0.XAxis)
    y = unit(cs0.YAxis)
    z = unit(cs0.ZAxis)

    # 4) возвращаем корректную КС
    return CoordinateSystem.ByOriginVectors(o, x, y, z)

def to_local_point(pt, cs):
    p = pt.Transform(cs.Inverse())
    return p.X, p.Y, p.Z

def boundary_xy_local(pc, cs):
    verts = []
    for crv in pc.Curves():
        x,y,_ = to_local_point(crv.StartPoint, cs)
        verts.append((x,y))
    xe, ye, _ = to_local_point(pc.Curves()[-1].EndPoint, cs)
    if abs(verts[0][0]-xe)>EPS or abs(verts[0][1]-ye)>EPS:
        verts.append((xe,ye))
    return verts

# --- winding number (устойчивее на вершинах) ---
def wn_point_in_poly(px, py, V, eps=1e-9):
    wn = 0
    n = len(V)-1
    for i in range(n):
        x1,y1 = V[i]; x2,y2 = V[i+1]
        # точка на ребре
        if (min(x1,x2)-eps <= px <= max(x1,x2)+eps and
            min(y1,y2)-eps <= py <= max(y1,y2)+eps):
            if abs((x2-x1)*(py-y1) - (y2-y1)*(px-x1)) <= eps:
                return True
        if y1 <= py:
            if y2 > py and (x2-x1)*(py-y1) - (y2-y1)*(px-x1) > 0: wn += 1
        else:
            if y2 <= py and (x2-x1)*(py-y1) - (y2-y1)*(px-x1) < 0: wn -= 1
    return wn != 0

def orient(ax,ay,bx,by,cx,cy):
    return (bx-ax)*(cy-ay) - (by-ay)*(cx-ax)

def segments_intersect(a,b,c,d, tol=1e-9, touch_ok=True):
    ax,ay=a; bx,by=b; cx,cy=c; dx,dy=d
    o1 = orient(ax,ay,bx,by,cx,cy); o2 = orient(ax,ay,bx,by,dx,dy)
    o3 = orient(cx,cy,dx,dy,ax,ay); o4 = orient(cx,cy,dx,dy,bx,by)
    if (o1*o2 < -tol and o3*o4 < -tol): return True
    def onseg(p,q,r):
        px,py=p; qx,qy=q; rx,ry=r
        return (min(px,rx)-tol <= qx <= max(px,rx)+tol and min(py,ry)-tol <= qy <= max(py,ry)+tol)
    if abs(o1)<=tol and onseg(a,c,b): return not touch_ok
    if abs(o2)<=tol and onseg(a,d,b): return not touch_ok
    if abs(o3)<=tol and onseg(c,a,d): return not touch_ok
    if abs(o4)<=tol and onseg(c,b,d): return not touch_ok
    return False

def rect_inside_strict(x0,y0,x1,y1, V):
    # динамический inset от размера ячейки
    w = abs(x1-x0); h = abs(y1-y0)
    fc = max(0.008, 0.5*EPS/max(w,h,1.0))  # ~0.8% или чуть больше эпсилон/размер
    fe = fc*0.5
    cx,cy = 0.5*(x0+x1), 0.5*(y0+y1)
    # углы + середины рёбер, сдвинутые внутрь
    corners = [(x0+(cx-x0)*fc, y0+(cy-y0)*fc),
               (x1+(cx-x1)*fc, y0+(cy-y0)*fc),
               (x1+(cx-x1)*fc, y1+(cy-y1)*fc),
               (x0+(cx-x0)*fc, y1+(cy-y1)*fc)]
    edges = [(0.5*(x0+x1)+(cx-0.5*(x0+x1))*fe, y0+(cy-y0)*fe),
             (x1+(cx-x1)*fe, 0.5*(y0+y1)+(cy-0.5*(y0+y1))*fe),
             (0.5*(x0+x1)+(cx-0.5*(x0+x1))*fe, y1+(cy-y1)*fe),
             (x0+(cx-x0)*fe, 0.5*(y0+y1)+(cy-0.5*(y0+y1))*fe)]
    if not all(wn_point_in_poly(px,py,V) for (px,py) in corners+edges+[ (cx,cy) ]):
        return False
    # рёбра прямоугольника не должны пересекать границу (кроме касания)
    re = [((x0,y0),(x1,y0)), ((x1,y0),(x1,y1)), ((x1,y1),(x0,y1)), ((x0,y1),(x0,y0))]
    for i in range(len(V)-1):
        e = (V[i], V[i+1])
        for r in re:
            if segments_intersect(r[0], r[1], e[0], e[1], tol=1e-9, touch_ok=True):
                # легкое вдвигание внутрь и повторная проверка
                (px1,py1),(px2,py2) = r
                px1i,py1i = (px1+(cx-px1)*1e-4, py1+(cy-py1)*1e-4)
                px2i,py2i = (px2+(cx-px2)*1e-4, py2+(cy-py2)*1e-4)
                if segments_intersect((px1i,py1i),(px2i,py2i), e[0], e[1], tol=1e-9, touch_ok=True):
                    return False
    return True

# ---------- Inputs ----------
boundary = IN[0]
splitters_in = IN[1] if len(IN)>1 else None
if splitters_in and not isinstance(splitters_in, list): splitters_in=[splitters_in]

if not boundary:
    OUT=[]
else:
    cs = get_local_cs(boundary)
    V = boundary_xy_local(boundary, cs)
    if V[0]!=V[-1]: V.append(V[0])

    # уровни: все X/Y вершин + из сплиттеров (поддержка линий и точек)
    x_levels = [x for x,_ in V]
    y_levels = [y for _,y in V]
    if splitters_in:
        for g in splitters_in:
            if isinstance(g, Curve):
                x1,y1,_=to_local_point(g.StartPoint, cs); x2,y2,_=to_local_point(g.EndPoint, cs)
                if abs(x1-x2)<1e-6 and abs(y1-y2)<1e-6:
                    x_levels.append(x1); y_levels.append(y1)
                else:
                    if abs(x1-x2)<1e-6: x_levels.append(x1)
                    if abs(y1-y2)<1e-6: y_levels.append(y1)
            elif isinstance(g, Point):
                x,y,_=to_local_point(g, cs); x_levels.append(x); y_levels.append(y)

    x_levels = uniq_sorted(x_levels, EPS)
    y_levels = uniq_sorted(y_levels, EPS)

    # генерим зоны
    zones=[]
    for yi in range(len(y_levels)-1):
        y0,y1 = y_levels[yi], y_levels[yi+1]
        for xi in range(len(x_levels)-1):
            x0,x1 = x_levels[xi], x_levels[xi+1]
            if rect_inside_strict(x0,y0,x1,y1, V):
                bl=Point.ByCartesianCoordinates(cs,x0,y0,0)
                br=Point.ByCartesianCoordinates(cs,x1,y0,0)
                tr=Point.ByCartesianCoordinates(cs,x1,y1,0)
                tl=Point.ByCartesianCoordinates(cs,x0,y1,0)
                zones.append(PolyCurve.ByPoints([bl,br,tr,tl,bl]))

    OUT = zones
# ----------------------------------------

# group: Get Placement from Level
code_block_5 = CodeBlock { "ILevelObject"; }
getInterfaceByName_2 = DynRenga.RengaAPI.IModelObject.GetInterfaceByName(iModelObject=getById, interfaceName=code_block_5)
getPlacement = DynRenga.RengaAPI.ILevelObject.GetPlacement(iLevelObject=getInterfaceByName_2)

placement3DToCoordinateSystem = DynRenga.Converters.Renga.PlacementConverter.Placement3DToCoordinateSystem(placement=getPlacement)
transform = Geometry.Transform(geometry=code_block_3, cs=placement3DToCoordinateSystem, lacing=Longest)
color_palette = ColorPalette({R: 0, G: 204, B: 5, A: 255})
byGeometryColor = Modifiers.GeometryColor.ByGeometryColor(geometry=transform, color=color_palette)
color_palette_2 = ColorPalette({R: 255, G: 0, B: 0, A: 255})
byGeometryColor_2 = Modifiers.GeometryColor.ByGeometryColor(geometry=code_block_4, color=color_palette_2)
code_block_6 = CodeBlock(contour_mainBaseline=toDynamoPolyCurveOptimized) { contour_mainBaseline; }

# group: Получение светильников > Получение объектов
getAllObjectTypes = DynRenga.RengaAPI.Constants.ObjectTypes.GetAllObjectTypes()
code_block_7 = CodeBlock { "LightingFixture"; }
valueAtKey = DesignScript.Builtin.Dictionary.ValueAtKey(dictionary=getAllObjectTypes.ObjectTypes, key=code_block_7)
getObjectsByType = DynRenga.RengaAPI.IModelObjectCollection.GetObjectsByType(iModelObjectCollection=getObjects, objectType=valueAtKey)
id = DynRenga.RengaAPI.IModelObject.Id(iModelObject=getObjectsByType)

# group: Получение светильников
project = DynRenga.RengaAPI.IApplication.Project(iApplication=IApplication)
IDataExporter = DynRenga.RengaAPI.IDataExporter.IDataExporter(project=project)
getObjects3D = DynRenga.RengaAPI.IDataExporter.GetObjects3D(iDataExporter=IDataExporter)
getObjectsByModelObjectId = DynRenga.RengaAPI.IExportedObject3DCollection.GetObjectsByModelObjectId(iExportedObject3DCollection=getObjects3D, modelObjectId=id)
exportedObjectToDynamoGeometry = DynRenga.Converters.Renga.MeshConverter.ExportedObjectToDynamoGeometry(exported=getObjectsByModelObjectId)
vertexPositions = Mesh.VertexPositions(mesh=exportedObjectToDynamoGeometry.Meshes)
byBestFitThroughPoints = Circle.ByBestFitThroughPoints(points=vertexPositions)
getParameters = DynRenga.RengaAPI.IModelObject.GetParameters(iModelObject=getObjectsByType)
getAllParameters = DynRenga.RengaAPI.IParameterContainer.GetAllParameters(iParameterContainer=getParameters)
definition = DynRenga.RengaAPI.IParameter.Definition(iParameter=getAllParameters)
name = DynRenga.RengaAPI.IParameterDefinition.Name(iParameterDefinition=definition)
text = DynRenga.RengaAPI.IParameterDefinition.Text(iParameterDefinition=definition)
getQuantities = DynRenga.RengaAPI.IModelObject.GetQuantities(iModelObject=getObjectsByType)
getAllObjects = DynRenga.RengaAPI.IExportedObject3DCollection.GetAllObjects(iExportedObject3DCollection=getObjects3D)
exportedObjectToBoundingBox = DynRenga.Converters.Renga.MeshConverter.ExportedObjectToBoundingBox(exported=getObjectsByModelObjectId)
toCuboid = BoundingBox.ToCuboid(boundingBox=exportedObjectToBoundingBox)
code_block_8 = CodeBlock { 50; }
color_palette_3 = ColorPalette({R: 255, G: 0, B: 73, A: 255})
components = Color.Components(color=color_palette_3)
byARGB = Color.ByARGB(alpha=code_block_8, red=components.red, green=components.green, blue=components.blue)
byMeshColors = Modifiers.GeometryColor.ByMeshColors(mesh=exportedObjectToDynamoGeometry.Meshes, colors=byARGB)
byBestFitThroughPoints_2 = Line.ByBestFitThroughPoints(bestFitPoints=vertexPositions)
code_block_9 = CodeBlock { 0.5; }

# group: Получение светильников > Выбор точек
centerPoint = Circle.CenterPoint(circle=byBestFitThroughPoints)
code_block_10 = CodeBlock(choice=centerPoint) { choice; }
centroid = Solid.Centroid(solid=toCuboid)
pointAtParameter = Curve.PointAtParameter(curve=byBestFitThroughPoints_2, param=code_block_9)

code_block_11 = CodeBlock(cs=placement3DToCoordinateSystem, zones=python_script_2, points=code_block_10) { cs; zones; points; }

# group: Находим и разделям зоны со светильниками и без
code_block_12 = CodeBlock(cs=code_block_11.cs, zones=code_block_11.zones, points=code_block_11.points) { cs; zones; points; }
code_block_13 = CodeBlock(input=code_block_12.zones) { input; }
byPatch = Surface.ByPatch(closedCurve=code_block_13)
inverse = CoordinateSystem.Inverse(coordinateSystem=code_block_12.cs)
transform_2 = Geometry.Transform(geometry=code_block_12.points, cs=inverse, lacing=Longest)
Z = Point.Z(point=transform_2)
code_block_14 = CodeBlock(x=Z) { -x; }
translate = Geometry.Translate(geometry=transform_2, zTranslation=code_block_14)
flatten = List.Flatten(list=translate)
doesIntersect = Geometry.DoesIntersect(geometry=byPatch, other=flatten, lacing=CrossProduct)
anyTrue = List.AnyTrue(list=doesIntersect, lacing=Longest)
filterByBoolMask = List.FilterByBoolMask(list=code_block_13, mask=anyTrue)
code_block_15 = CodeBlock(has_points=filterByBoolMask.in, no_points=filterByBoolMask.out) { has_points; no_points; }
countTrue = List.CountTrue(list=doesIntersect, lacing=Longest)
filterByBoolMask_2 = List.FilterByBoolMask(list=countTrue, mask=anyTrue)
code_block_16 = CodeBlock(has_points=filterByBoolMask_2.in, no_points=filterByBoolMask_2.out) { has_points; no_points; }

# group: Дополнительное разделение зон
code_block_17 = CodeBlock(contour_mainBaseline=code_block_6, zone_hasPoints=code_block_15.has_points, zone_nonPoints=code_block_15.no_points) { contour_mainBaseline; zone_hasPoints; zone_nonPoints; }
code_block_18 = CodeBlock(no_points=code_block_17.zone_nonPoints) { no_points; }
python_script_3 = Python(IN[0]=code_block_17.zone_nonPoints)  # CPython3
# ---------- python_script_3.python (180 lines) ----------
# Dynamo Python script
# Split a closed polycurve (polygon) into two polygons of equal area.
# The split line is parallel to the longest polygon edge.
# Inputs:
#   IN[0] : polygon (Autodesk.DesignScript Geometry Polygon / PolyCurve) or list of points
# Output:
#   OUT : dict or list of dicts with keys {"polyA","polyB","sepLine"}

import clr
clr.AddReference('ProtoGeometry')
from Autodesk.DesignScript.Geometry import Point, Polygon, PolyCurve, Line
import math

# read input
src = IN[0]

# helpers to extract 2D point tuples from several possible input shapes
def to_point_list(obj):
    try:
        if isinstance(obj, list) and len(obj)>0 and hasattr(obj[0], 'X'):
            return [(p.X, p.Y) for p in obj]
    except:
        pass
    try:
        pts = []
        if hasattr(obj, "Vertices"):
            for v in obj.Vertices:
                pts.append((v.X, v.Y))
            return pts
        if hasattr(obj, "Points"):
            for v in obj.Points:
                pts.append((v.X, v.Y))
            return pts
    except:
        pass
    try:
        if hasattr(obj, "Coordinates"):
            return [(c.X, c.Y) for c in obj.Coordinates]
    except:
        pass
    if isinstance(obj, list) and len(obj)>0 and isinstance(obj[0], (tuple, list)):
        return [(float(x), float(y)) for x,y in obj]
    return None

def sub(a,b): return (a[0]-b[0], a[1]-b[1])
def add(a,b): return (a[0]+b[0], a[1]+b[1])
def mul(a,s): return (a[0]*s, a[1]*s)
def dot(a,b): return a[0]*b[0] + a[1]*b[1]
def length(a): return math.hypot(a[0], a[1])

def polygon_area(poly):
    a = 0.0
    for i in range(len(poly)-1):
        x1,y1 = poly[i]
        x2,y2 = poly[i+1]
        a += x1*y2 - x2*y1
    return abs(a) * 0.5

def clip_halfspace(poly, nvec, t):
    res = []
    for i in range(len(poly)-1):
        P = poly[i]
        Q = poly[i+1]
        dP = dot(nvec, P) - t
        dQ = dot(nvec, Q) - t
        if dP <= 0:
            res.append(P)
        if dP * dQ < 0:
            s = dP / (dP - dQ)
            inter = add(P, mul(sub(Q,P), s))
            res.append(inter)
    if len(res) > 0 and res[0] != res[-1]:
        res.append(res[0])
    return res

def make_polycurve_from_xy(xylist):
    if not xylist or len(xylist) < 4:
        return None
    points = [Point.ByCoordinates(x,y,0) for x,y in xylist[:-1]]
    try:
        return PolyCurve.CloseWithLine(PolyCurve.ByPoints(points))
    except:
        return PolyCurve.CloseWithLine(PolyCurve.ByPoints(points))

def unique_pts(pts, tol=1e-9):
    seen = set()
    out = []
    for x,y in pts:
        key = (round(x/tol)*tol, round(y/tol)*tol)
        if key not in seen:
            seen.add(key)
            out.append((x,y))
    return out

def separation_segment(pts, n, t, v_dir):
    inters = []
    for i in range(len(pts)-1):
        P = pts[i]
        Q = pts[i+1]
        dP = dot(n, P) - t
        dQ = dot(n, Q) - t
        if abs(dP) < 1e-12:
            inters.append(P)
        if abs(dQ) < 1e-12:
            inters.append(Q)
        if dP * dQ < 0:
            s = dP / (dP - dQ)
            inter = add(P, mul(sub(Q,P), s))
            inters.append(inter)

    inters = unique_pts(inters, tol=1e-9)
    if len(inters) < 2:
        return None, None

    projs = [(dot(v_dir, p), p) for p in inters]
    p_start = min(projs, key=lambda x: x[0])[1]
    p_end   = max(projs, key=lambda x: x[0])[1]

    return Point.ByCoordinates(p_start[0], p_start[1], 0), Point.ByCoordinates(p_end[0], p_end[1], 0)

def process_one(item):
    pts = to_point_list(item)
    if not pts or len(pts) < 3:
        return {"polyA": None, "polyB": None, "sepLine": None}

    if pts[0] != pts[-1]:
        pts = pts[:]
        pts.append(pts[0])

    maxlen = -1.0
    maxdir = (1.0, 0.0)
    for i in range(len(pts)-1):
        a = pts[i]
        b = pts[i+1]
        v = sub(b,a)
        l = length(v)
        if l > maxlen:
            maxlen = l
            if l > 0:
                maxdir = (v[0]/l, v[1]/l)

    v = maxdir
    n = (-v[1], v[0])

    total_area = polygon_area(pts)

    projs = [dot(n, p) for p in pts[:-1]]
    pmin = min(projs) - 1e-6
    pmax = max(projs) + 1e-6

    target = total_area * 0.5
    lo = pmin
    hi = pmax
    for _ in range(60):
        t = (lo + hi) / 2.0
        left_poly = clip_halfspace(pts, n, t)
        a_left = polygon_area(left_poly) if len(left_poly) >= 4 else 0.0
        if a_left > target:
            hi = t
        else:
            lo = t

    t = (lo + hi) / 2.0
    polyA_pts = clip_halfspace(pts, n, t)
    negn = (-n[0], -n[1])
    polyB_pts = clip_halfspace(pts, negn, -t)

    polyA = make_polycurve_from_xy(polyA_pts)
    polyB = make_polycurve_from_xy(polyB_pts)

    p0, p1 = separation_segment(pts, n, t, v)
    sep_line = Line.ByStartPointEndPoint(p0, p1) if p0 and p1 else None

    return {"poly": [polyA, polyB], "line": sep_line}

# single item -> dict, list of items -> list of dicts
if isinstance(src, list) and to_point_list(src) is None:
    OUT = [process_one(s) for s in src]
else:
    OUT = process_one(src)
# ----------------------------------------
code_block_19 = CodeBlock { "line"; }
valueAtKey_2 = DesignScript.Builtin.Dictionary.ValueAtKey(dictionary=python_script_3, key=code_block_19)
python_script_4 = Python(IN[0]=code_block_17.contour_mainBaseline, IN[1]=valueAtKey_2)  # CPython3
# ---------- python_script_4.python (161 lines) ----------
# Dynamo Python script (robust to very small/large inputs via normalization)
# IN[0]: closed perimeter (Polygon or PolyCurve)
# IN[1]: line or list of lines
# OUT: extended line(s) clipped to perimeter edges

import clr
clr.AddReference('ProtoGeometry')
from Autodesk.DesignScript.Geometry import Point, Line, PolyCurve, Polygon
import math

perim_in = IN[0][0]
lines_in = IN[1]

# ---------- geometry conversion ----------
def to_polycurve_closed(g):
    if isinstance(g, PolyCurve):
        return g
    if isinstance(g, Polygon):
        try: return g.ToPolyCurve()
        except: pass
        try: return PolyCurve.CloseWithLine(PolyCurve.ByPoints(list(g.Points)))
        except: pass
    try:
        pts = []
        if hasattr(g, "Vertices"): pts = list(g.Vertices)
        elif hasattr(g, "Points"): pts = list(g.Points)
        if pts and pts[0] != pts[-1]: pts = pts + [pts[0]]
        if pts:
            return PolyCurve.CloseWithLine(PolyCurve.ByPoints(pts))
    except:
        pass
    return None

def pc_points2d(pc):
    # returns list of (x,y,z) from polycurve polygonal approximation
    pts = []
    if hasattr(pc, "Points"):
        for p in pc.Points: pts.append((p.X,p.Y,p.Z))
    elif hasattr(pc, "Vertices"):
        for p in pc.Vertices: pts.append((p.X,p.Y,p.Z))
    else:
        # last resort: explode and collect endpoints
        for crv in pc.Curves():
            sp = crv.StartPoint; ep = crv.EndPoint
            if not pts: pts.append((sp.X,sp.Y,sp.Z))
            pts.append((ep.X,ep.Y,ep.Z))
    # ensure closed
    if pts and pts[0] != pts[-1]: pts.append(pts[0])
    return pts

def rebuild_polycurve_from_xyz(xyz):
    if not xyz or len(xyz)<4: return None
    pts = [Point.ByCoordinates(x,y,z) for (x,y,z) in xyz[:-1]]
    return PolyCurve.CloseWithLine(PolyCurve.ByPoints(pts))

# ---------- normalization (translate + scale) ----------
def bbox_from_points(pts):
    xs = [p[0] for p in pts]; ys = [p[1] for p in pts]; zs = [p[2] for p in pts]
    return (min(xs),min(ys),min(zs), max(xs),max(ys),max(zs))

def normalize(perim_pc, lines):
    # collect perimeter points
    p_xyz = pc_points2d(perim_pc)
    if not p_xyz: return None
    mnx,mny,mnz, mxx,mxy,mxz = bbox_from_points(p_xyz)
    cx = 0.5*(mnx+mxx); cy = 0.5*(mny+mxy); cz = 0.5*(mnz+mxz)
    span = max(mxx-mnx, mxy-mny, max(1e-9, mxz-mnz))
    # choose target span ~100 for numeric stability
    target = 100.0
    s = target / max(span, 1e-12)

    def npt(pt):
        return ((pt[0]-cx)*s, (pt[1]-cy)*s, (pt[2]-cz)*s)

    # norm perimeter
    pN = [npt(p) for p in p_xyz]
    perimN = rebuild_polycurve_from_xyz(pN)

    # norm lines
    def nline(ln):
        a = ((ln.StartPoint.X-cx)*s, (ln.StartPoint.Y-cy)*s, (ln.StartPoint.Z-cz)*s)
        b = ((ln.EndPoint.X-cx)*s, (ln.EndPoint.Y-cy)*s, (ln.EndPoint.Z-cz)*s)
        return Line.ByStartPointEndPoint(Point.ByCoordinates(*a), Point.ByCoordinates(*b))

    linesN = [nline(ln) for ln in (lines if isinstance(lines, list) else [lines])]

    # inverse
    inv = (cx,cy,cz, 1.0/s)
    return perimN, linesN, inv

def denorm_line(ln, inv):
    cx,cy,cz, invs = inv
    a = ln.StartPoint; b = ln.EndPoint
    A = Point.ByCoordinates(a.X*invs+cx, a.Y*invs+cy, a.Z*invs+cz)
    B = Point.ByCoordinates(b.X*invs+cx, b.Y*invs+cy, b.Z*invs+cz)
    return Line.ByStartPointEndPoint(A,B)

# ---------- intersection helpers ----------
def vec(a,b): return (b.X-a.X, b.Y-a.Y, b.Z-a.Z)
def vlen(v): return math.sqrt(v[0]*v[0]+v[1]*v[1]+v[2]*v[2])
def vnorm(v):
    l=vlen(v)
    return (1.0,0.0,0.0) if l==0 else (v[0]/l,v[1]/l,v[2]/l)
def vscale(v,s): return (v[0]*s,v[1]*s,v[2]*s)
def pt_add(p,v): return Point.ByCoordinates(p.X+v[0], p.Y+v[1], p.Z+v[2])

def collect_intersection_points(geomA, geomB):
    res = []
    try:
        xs = geomA.Intersect(geomB)
        if not xs: return res
        for x in xs:
            if hasattr(x, "X") and hasattr(x, "Y"):
                res.append(x)
            elif isinstance(x, Line):
                res.append(x.StartPoint); res.append(x.EndPoint)
            elif hasattr(x, "StartPoint") and hasattr(x, "EndPoint"):
                res.append(x.StartPoint); res.append(x.EndPoint)
    except:
        pass
    return res

def extend_line_to_perimeter(perim_pc, line):
    p0 = line.StartPoint; p1 = line.EndPoint
    d = vnorm(vec(p0,p1))
    mid = Point.ByCoordinates((p0.X+p1.X)*0.5, (p0.Y+p1.Y)*0.5, (p0.Z+p1.Z)*0.5)
    # long line length based on normalized perimeter size
    L = 1000.0
    far0 = pt_add(mid, vscale(d, -L))
    far1 = pt_add(mid, vscale(d,  L))
    long_line = Line.ByStartPointEndPoint(far0, far1)

    pts = collect_intersection_points(long_line, perim_pc)
    if len(pts) < 2:
        pts2 = collect_intersection_points(line, perim_pc)
        if len(pts2) >= 2: pts = pts2
        else: return line

    # order along direction
    def proj(p): return (p.X-mid.X)*d[0] + (p.Y-mid.Y)*d[1] + (p.Z-mid.Z)*d[2]
    pts.sort(key=proj)
    a = pts[0]; b = pts[-1]
    if a.DistanceTo(b) <= 1e-8: return line
    return Line.ByStartPointEndPoint(a,b)

# ---------- main ----------
perim_pc = to_polycurve_closed(perim_in)
if perim_pc is None:
    OUT = None
else:
    norm = normalize(perim_pc, lines_in)
    if norm is None:
        OUT = lines_in
    else:
        perimN, linesN, inv = norm
        if isinstance(lines_in, list):
            extendedN = [extend_line_to_perimeter(perimN, ln) for ln in linesN]
            OUT = [denorm_line(ln, inv) for ln in extendedN]
        else:
            extendedN = extend_line_to_perimeter(perimN, linesN[0])
            OUT = denorm_line(extendedN, inv)
# ----------------------------------------
code_block_20 = CodeBlock(has_points=code_block_17.zone_hasPoints) { has_points; }

# group: CoreNodeModels.ColorRange
# Inserted Dynamo graph
byPatch_2 = Surface.ByPatch(closedCurve=code_block_17.zone_hasPoints)
code_block_21 = CodeBlock(input=byPatch_2) { input; }
color_palette_4 = ColorPalette({R: 0, G: 254, B: 1, A: 255})
color_palette_5 = ColorPalette({R: 0, G: 255, B: 191, A: 255})
color_palette_6 = ColorPalette({R: 0, G: 192, B: 255, A: 255})
color_palette_7 = ColorPalette({R: 0, G: 67, B: 255, A: 255})
list_create = List.Create(item0=color_palette_4, item1=color_palette_5, item2=color_palette_6, item3=color_palette_7)
code_block_22 = CodeBlock(c=list_create) { 0..1..#List.Count(c); }
code_block_23 = CodeBlock(c=code_block_21) { 0..1..#List.Count(c); }
color_range = ColorRange(colors=list_create, indices=code_block_22, value=code_block_23)
code_block_24 = CodeBlock(t1=color_range)
# ---------- code_block_24.designscript (6 lines) ----------
t2 = DSCore.Color.Components(t1);
t3 = Dictionary.ValueAtKey(t2, "alpha");
t4 = Dictionary.ValueAtKey(t2, "red");
t5 = Dictionary.ValueAtKey(t2, "green");
t6 = Dictionary.ValueAtKey(t2, "blue");
color1 = DSCore.Color.ByARGB(100, t4, t5, t6);
# ----------------------------------------
byGeometryColor_3 = Modifiers.GeometryColor.ByGeometryColor(geometry=code_block_21, color=code_block_24.color1)

# group: Поиск смежный внутри списка
code_block_25 = CodeBlock { input1; }  # unwired: input1
code_block_26 = CodeBlock { 0.01; }
python_script_5 = Python(IN[0]=code_block_25, IN[1]=code_block_26)  # CPython3
# ---------- python_script_5.python (323 lines) ----------
"""
Dynamo Python (IronPython 2.7) script: find_rectangle_neighbors_dynamo.py

Inputs (Dynamo Python node):
    polycurves: list of Dynamo PolyCurve (each rectangle as closed polycurve)
    tol: float tolerance for geometric comparisons (default 1e-6)

Output (Dynamo Python node):
    neighbors_by_index: list of lists, where each inner list contains indices of polycurves
                        that touch the polycurve at one or more side edges.

Notes:
- This script uses only Dynamo geometry objects and basic math; it should run inside
  Dynamo's IronPython 2.7 environment (no external packages required).
- The script assumes rectangles are closed PolyCurves composed of 4 contiguous line segments.
- The neighbor test between two rectangles checks each segment pair for:
    1) collinearity (within tolerance)
    2) 1D overlap of the projected segment intervals (within tolerance)
    3) not just touching at a corner (overlap length > tol) unless you want to include corner-only contacts.

Usage in Dynamo Python node:
- Inputs:
    IN[0] -> polycurves
    IN[1] -> tol
- Output:
    OUT -> neighbors_by_index

Example:
    rectangles = [rectA, rectB, rectC]
    tol = 1e-6
    neighbors_by_index = find_neighbors(rectangles, tol)

Return format example:
    [[1], [0,2], [1]]  # rect 0 neighbors: [1]; rect1 neighbors: [0,2]; rect2: [1]

Author: Generated for user
"""

import math

# Dynamo geometry helpers: to keep compatibility with IronPython without explicit imports
# we will assume the incoming objects behave like Dynamo Geometry PolyCurve and Line objects.

# Helper: compare floats
def is_close(a, b, tol):
    return abs(a - b) <= tol

# Convert a Dynamo line to a tuple of start/end points (each point has X,Y,Z attributes)
def line_endpoints(line):
    # Dynamo Line has .StartPoint and .EndPoint or .Start and .End depending on version
    try:
        a = line.StartPoint
        b = line.EndPoint
    except Exception:
        a = line.Start
        b = line.End
    return a, b

# Vector utilities (points/vectors have .X, .Y, .Z)
def vec_sub(a, b):
    return (a.X - b.X, a.Y - b.Y, a.Z - b.Z)

def dot(u, v):
    return u[0]*v[0] + u[1]*v[1] + u[2]*v[2]

def cross(u, v):
    return (u[1]*v[2] - u[2]*v[1], u[2]*v[0] - u[0]*v[2], u[0]*v[1] - u[1]*v[0])

def length(v):
    return math.sqrt(dot(v, v))

# Check if two 3D vectors are collinear within tol: cross product magnitude small and direction aligned
def are_collinear(u, v, tol):
    c = cross(u, v)
    return length(c) <= tol * max(1.0, length(u), length(v))

# Project a point onto a line defined by origin O and direction D (D does not need to be unit)
# returns scalar parameter t where P = O + t*D
def project_param(O, D, P):
    OP = vec_sub(P, O)
    denom = dot(D, D)
    if denom == 0:
        return 0.0
    return dot(OP, D) / denom

# Check 1D overlap between intervals [a0,a1] and [b0,b1] with tolerance
# Returns overlap length (>= 0)
def interval_overlap(a0, a1, b0, b1, tol):
    if a1 < a0:
        a0, a1 = a1, a0
    if b1 < b0:
        b0, b1 = b1, b0
    lo = max(a0, b0)
    hi = min(a1, b1)
    ov = hi - lo
    if ov <= tol:
        return 0.0
    return ov

# Given two Dynamo Line segments, check if they lie on the same infinite line (collinear) and overlap
# Returns True if they overlap by more than tol (i.e., share a side), False otherwise
def segments_touch_by_side(line1, line2, tol):
    a1, a2 = line_endpoints(line1)
    b1, b2 = line_endpoints(line2)
    u = vec_sub(a2, a1)
    v = vec_sub(b2, b1)

    if length(u) < tol or length(v) < tol:
        return False
# Dynamo / IronPython 2.7 script
# Purpose: Given a list of Dynamo PolyCurves (rectangles), return for each polycurve
# the list of neighbor indices that share an edge with it. Corner-only touches are
# excluded (i.e., touching at a single point does not count as a neighbor).
#
# Inputs:
#   IN[0] -> curves : list of PolyCurve (Dynamo geometry)
#   IN[1] -> tol : float (optional) - distance tolerance for geometric checks (default 1e-6)
#
# Output:
#   OUT -> neighbors_by_index : list of lists of indices
#
# Usage notes:
# - Wire your list of closed PolyCurves (rectangles) into IN[0].
# - Optionally wire a small tolerance (meters or model units) into IN[1].
# - The script will only treat two polycurves as neighbors if they have a
#   non-zero overlapping edge (overlap length > tol). If they only touch at
#   a corner point, they are NOT considered neighbors.
#
# Example (conceptual):
# - Rect A and Rect B share a full side -> A neighbors include B and vice versa.
# - Rect C touches Rect A only at a single corner -> not a neighbor.
# Expected output for [A,B,C] would be something like: [[1],[0],[]]
#
# Concrete conceptual layout (indices):
# 0: Rect A at origin spanning (0,0)-(2,1)
# 1: Rect B to the right of A spanning (2,0)-(4,1)  # shares vertical edge x=2 with A -> edge-touch
# 2: Rect C above A spanning (2,1)-(3,2)            # touches A only at corner (2,1) -> NOT neighbor
#
# Expected neighbors: [[1], [0], []]

import clr
import System
from System import Array

# Dynamo geometry types
clr.AddReference('ProtoGeometry')
from Autodesk.DesignScript.Geometry import Point, Vector, CoordinateSystem

# Helper math
import math

def is_zero(val, tol):
    return abs(val) <= tol

def are_vectors_collinear(v1, v2, tol_angle):
    # Check if v1 and v2 are collinear (parallel or anti-parallel) within tol_angle (radians)
    cross_x = v1.Y * v2.Z - v1.Z * v2.Y
    cross_y = v1.Z * v2.X - v1.X * v2.Z
    cross_z = v1.X * v2.Y - v1.Y * v2.X
    cross_mag = math.sqrt(cross_x*cross_x + cross_y*cross_y + cross_z*cross_z)
    denom = v1.Length * v2.Length
    if is_zero(denom, 1e-12):
        return False
    sin_theta = cross_mag / denom
    theta = math.asin(min(1.0, max(-1.0, sin_theta)))
    return abs(theta) <= tol_angle

def project_point_onto_line_param(pt, line_p0, dir_vec):
    # Parametric projection t such that projection = line_p0 + t * dir_vec
    dx = pt.X - line_p0.X
    dy = pt.Y - line_p0.Y
    dz = pt.Z - line_p0.Z
    dot1 = dx * dir_vec.X + dy * dir_vec.Y + dz * dir_vec.Z
    dot2 = dir_vec.X * dir_vec.X + dir_vec.Y * dir_vec.Y + dir_vec.Z * dir_vec.Z
    if is_zero(dot2, 1e-12):
        return None
    return dot1 / dot2

def perp_distance_point_to_line(pt, line_p0, dir_vec, dir_len):
    # Perpendicular distance from pt to infinite line defined by (line_p0, dir_vec)
    vx = pt.X - line_p0.X
    vy = pt.Y - line_p0.Y
    vz = pt.Z - line_p0.Z
    cross_x = vy * dir_vec.Z - vz * dir_vec.Y
    cross_y = vz * dir_vec.X - vx * dir_vec.Z
    cross_z = vx * dir_vec.Y - vy * dir_vec.X
    cross_mag = math.sqrt(cross_x*cross_x + cross_y*cross_y + cross_z*cross_z)
    if is_zero(dir_len, 1e-12):
        return float('inf')
    return cross_mag / dir_len

# Main algorithm
# Support inputs:
# IN[0] -> listA : list of PolyCurves (rectangles) to find neighbors for
# IN[1] -> listB or tol : if this is a list, it's treated as listB to compare against listA.
#                           if it's a number or None, it's treated as tol and we compare within listA.
# IN[2] -> tol : optional tolerance when IN[1] is listB

# Dynamo provides IN when running inside a Dynamo Python node. Use a safe fallback
# to avoid NameError during static analysis or local runs.
IN = globals().get('IN', [None, None, None])

listA = IN[0] if len(IN) > 0 else None
second = IN[1] if len(IN) > 1 else None
third = IN[2] if len(IN) > 2 else None

# Optional: when run as a normal Python script, allow a tiny demo (no Dynamo geometry)
if __name__ == '__main__':
    print('Running find_rectangle_neighbors_dynamo.py as standalone - no demo available for Dynamo geometry')

# Determine whether second is a list of curves or a numeric tolerance
def is_iterable(obj):
    try:
        iter(obj)
        return True
    except Exception:
        return False

if listA is None:
    OUT = []
else:
    # Decide inputs
    if second is None or (not is_iterable(second)) or isinstance(second, (float, int)):
        # single-list mode: compare within listA
        listB = listA
        tol = float(second) if second is not None else (float(third) if third is not None else 1e-6)
        symmetric = True
    else:
        # two-list mode: compare listA against listB (no symmetry)
        listB = second
        tol = float(third) if third is not None else 1e-6
        symmetric = False

    # Pre-extract segments for each polycurve in both lists
    def extract_segments(curves):
        segs_list = []
        for c in curves:
            try:
                segs = list(c.Curves())
            except Exception:
                segs = [c]
            segs_list.append(segs)
        return segs_list

    segsA = extract_segments(listA)
    segsB = extract_segments(listB)

    nA = len(listA)
    nB = len(listB)

    # Initialize neighbor lists for items in A (indices refer to listB indices)
    neighbors = [[] for _ in range(nA)]

    # Small angle tolerance for collinearity (radians)
    angle_tol = 1e-6

    for i in range(nA):
        segs_i = segsA[i]
        # Depending on symmetric mode we may avoid double-checking pairs
        j_start = 0
        for j in range(j_start, nB):
            # If symmetric and comparing listA to itself, avoid duplicate pairs and self
            if symmetric and j <= i:
                continue

            segs_j = segsB[j]
            touches = False

            # Compare each segment pair
            for si in segs_i:
                a0 = si.StartPoint
                a1 = si.EndPoint
                dir_i = Vector.ByTwoPoints(a0, a1)
                # precompute denom and length
                denom_len2 = dir_i.X*dir_i.X + dir_i.Y*dir_i.Y + dir_i.Z*dir_i.Z
                if is_zero(denom_len2, 1e-12):
                    continue
                dir_len = math.sqrt(denom_len2)

                for sj in segs_j:
                    b0 = sj.StartPoint
                    b1 = sj.EndPoint
                    dir_j = Vector.ByTwoPoints(b0, b1)

                    # Check collinearity of directions
                    if not are_vectors_collinear(dir_i, dir_j, angle_tol):
                        continue

                    # Project endpoints of sj onto line of si (parametric t where a0->0, a1->1)
                    tb0 = project_point_onto_line_param(b0, a0, dir_i)
                    tb1 = project_point_onto_line_param(b1, a0, dir_i)
                    if tb0 is None or tb1 is None:
                        continue

                    bmin = min(tb0, tb1)
                    bmax = max(tb0, tb1)

                    # Overlap between [0,1] and [bmin,bmax] in param units
                    overlap_param = min(1.0, bmax) - max(0.0, bmin)
                    # Convert overlap to absolute length along segment i
                    overlap_length = overlap_param * dir_len

                    # Require a positive overlapping edge longer than tol (not just a point)
                    if overlap_length <= tol:
                        # Too small or zero -> likely corner-only or gap
                        continue

                    # Ensure the other segment's endpoints are close to the line (within tol)
                    pd0 = perp_distance_point_to_line(b0, a0, dir_i, dir_len)
                    pd1 = perp_distance_point_to_line(b1, a0, dir_i, dir_len)
                    if pd0 <= tol + 1e-9 and pd1 <= tol + 1e-9:
                        touches = True
                        break
                if touches:
                    break

            if touches:
                neighbors[i].append(j)
                # If symmetric (same list) also append reverse
                if symmetric:
                    neighbors[j].append(i)

    OUT = neighbors
# ----------------------------------------
getItemAtIndex = List.GetItemAtIndex(list=code_block_25, index=python_script_5)

code_block_27 = CodeBlock { has_points; no_points; }  # unwired: has_points, no_points
byPatch_3 = Surface.ByPatch(closedCurve=code_block_27.no_points)
color_palette_8 = ColorPalette({R: 255, G: 0, B: 0, A: 255})
byGeometryColor_4 = Modifiers.GeometryColor.ByGeometryColor(geometry=byPatch_3, color=color_palette_8)
integer_slider = IntegerSlider(0, range=0..10 step 1)
code_block_28 = CodeBlock(a=byGeometryColor_4, b=integer_slider) { a[b]; }
code_block_29 = CodeBlock { has_points; no_points; }  # unwired: has_points, no_points

# group: Дополнительное разделение зон > Деление контура на сегменты
деление = Python(IN[0]=code_block_18, IN[1]=python_script_4)  # CPython3
# ---------- деление.python (183 lines) ----------
# python
import clr
clr.AddReference('ProtoGeometry')
from Autodesk.DesignScript.Geometry import *

EPS = 1e-6

def uniq_sorted(vals, tol=1e-6):
    vals = sorted(vals); out = []
    for v in vals:
        if not out or abs(v - out[-1]) > tol: out.append(v)
    return out

def get_local_cs(pc):
    # Нормализация вектора вручную (в некоторых сборках нет Normalize/Normalized)
    def unit(v):
        try:
            L = v.Length
        except:
            # если внезапно пришёл не Vector
            return v
        if L == 0: 
            return v
        return Vector.ByCoordinates(v.X / L, v.Y / L, v.Z / L)

    # 1) пробуем через Surface.ByPatch
    try:
        srf = Surface.ByPatch(pc)
        cs0 = srf.CoordinateSystemAtParameter(0.5, 0.5)
        try: srf.Dispose()
        except: pass
    except:
        # 2) fallback: best-fit plane
        pts = [c.StartPoint for c in pc.Curves()]
        pl = Plane.ByBestFitThroughPoints(pts)
        cs0 = CoordinateSystem.ByPlane(pl)
        for p in pts:
            try: p.Dispose()
            except: pass
        try: pl.Dispose()
        except: pass

    # 3) собираем оси как СВОЙСТВА (не вызываем!)
    o = cs0.Origin
    x = unit(cs0.XAxis)
    y = unit(cs0.YAxis)
    z = unit(cs0.ZAxis)

    # 4) возвращаем корректную КС
    return CoordinateSystem.ByOriginVectors(o, x, y, z)

def to_local_point(pt, cs):
    p = pt.Transform(cs.Inverse())
    return p.X, p.Y, p.Z

def boundary_xy_local(pc, cs):
    verts = []
    for crv in pc.Curves():
        x,y,_ = to_local_point(crv.StartPoint, cs)
        verts.append((x,y))
    xe, ye, _ = to_local_point(pc.Curves()[-1].EndPoint, cs)
    if abs(verts[0][0]-xe)>EPS or abs(verts[0][1]-ye)>EPS:
        verts.append((xe,ye))
    return verts

# --- winding number (устойчивее на вершинах) ---
def wn_point_in_poly(px, py, V, eps=1e-9):
    wn = 0
    n = len(V)-1
    for i in range(n):
        x1,y1 = V[i]; x2,y2 = V[i+1]
        # точка на ребре
        if (min(x1,x2)-eps <= px <= max(x1,x2)+eps and
            min(y1,y2)-eps <= py <= max(y1,y2)+eps):
            if abs((x2-x1)*(py-y1) - (y2-y1)*(px-x1)) <= eps:
                return True
        if y1 <= py:
            if y2 > py and (x2-x1)*(py-y1) - (y2-y1)*(px-x1) > 0: wn += 1
        else:
            if y2 <= py and (x2-x1)*(py-y1) - (y2-y1)*(px-x1) < 0: wn -= 1
    return wn != 0

def orient(ax,ay,bx,by,cx,cy):
    return (bx-ax)*(cy-ay) - (by-ay)*(cx-ax)

def segments_intersect(a,b,c,d, tol=1e-9, touch_ok=True):
    ax,ay=a; bx,by=b; cx,cy=c; dx,dy=d
    o1 = orient(ax,ay,bx,by,cx,cy); o2 = orient(ax,ay,bx,by,dx,dy)
    o3 = orient(cx,cy,dx,dy,ax,ay); o4 = orient(cx,cy,dx,dy,bx,by)
    if (o1*o2 < -tol and o3*o4 < -tol): return True
    def onseg(p,q,r):
        px,py=p; qx,qy=q; rx,ry=r
        return (min(px,rx)-tol <= qx <= max(px,rx)+tol and min(py,ry)-tol <= qy <= max(py,ry)+tol)
    if abs(o1)<=tol and onseg(a,c,b): return not touch_ok
    if abs(o2)<=tol and onseg(a,d,b): return not touch_ok
    if abs(o3)<=tol and onseg(c,a,d): return not touch_ok
    if abs(o4)<=tol and onseg(c,b,d): return not touch_ok
    return False

def rect_inside_strict(x0,y0,x1,y1, V):
    # динамический inset от размера ячейки
    w = abs(x1-x0); h = abs(y1-y0)
    fc = max(0.008, 0.5*EPS/max(w,h,1.0))  # ~0.8% или чуть больше эпсилон/размер
    fe = fc*0.5
    cx,cy = 0.5*(x0+x1), 0.5*(y0+y1)
    # углы + середины рёбер, сдвинутые внутрь
    corners = [(x0+(cx-x0)*fc, y0+(cy-y0)*fc),
               (x1+(cx-x1)*fc, y0+(cy-y0)*fc),
               (x1+(cx-x1)*fc, y1+(cy-y1)*fc),
               (x0+(cx-x0)*fc, y1+(cy-y1)*fc)]
    edges = [(0.5*(x0+x1)+(cx-0.5*(x0+x1))*fe, y0+(cy-y0)*fe),
             (x1+(cx-x1)*fe, 0.5*(y0+y1)+(cy-0.5*(y0+y1))*fe),
             (0.5*(x0+x1)+(cx-0.5*(x0+x1))*fe, y1+(cy-y1)*fe),
             (x0+(cx-x0)*fe, 0.5*(y0+y1)+(cy-0.5*(y0+y1))*fe)]
    if not all(wn_point_in_poly(px,py,V) for (px,py) in corners+edges+[ (cx,cy) ]):
        return False
    # рёбра прямоугольника не должны пересекать границу (кроме касания)
    re = [((x0,y0),(x1,y0)), ((x1,y0),(x1,y1)), ((x1,y1),(x0,y1)), ((x0,y1),(x0,y0))]
    for i in range(len(V)-1):
        e = (V[i], V[i+1])
        for r in re:
            if segments_intersect(r[0], r[1], e[0], e[1], tol=1e-9, touch_ok=True):
                # легкое вдвигание внутрь и повторная проверка
                (px1,py1),(px2,py2) = r
                px1i,py1i = (px1+(cx-px1)*1e-4, py1+(cy-py1)*1e-4)
                px2i,py2i = (px2+(cx-px2)*1e-4, py2+(cy-py2)*1e-4)
                if segments_intersect((px1i,py1i),(px2i,py2i), e[0], e[1], tol=1e-9, touch_ok=True):
                    return False
    return True

# ---------- Inputs ----------
boundaries = IN[0] if len(IN)>0 else None
splitters_in = IN[1] if len(IN)>1 else None
if splitters_in and not isinstance(splitters_in, list): splitters_in=[splitters_in]

# normalize boundaries to a list so we can accept single or multiple inputs
if boundaries is None:
    OUT = []
else:
    if not isinstance(boundaries, list):
        boundaries = [boundaries]

    all_zones = []
    for boundary in boundaries:
        if not boundary:
            continue
        cs = get_local_cs(boundary)
        V = boundary_xy_local(boundary, cs)
        if V[0]!=V[-1]: V.append(V[0])

        # уровни: все X/Y вершин + из сплиттеров (поддержка линий и точек)
        x_levels = [x for x,_ in V]
        y_levels = [y for _,y in V]
        if splitters_in:
            for g in splitters_in:
                if isinstance(g, Curve):
                    x1,y1,_=to_local_point(g.StartPoint, cs); x2,y2,_=to_local_point(g.EndPoint, cs)
                    if abs(x1-x2)<1e-6 and abs(y1-y2)<1e-6:
                        x_levels.append(x1); y_levels.append(y1)
                    else:
                        if abs(x1-x2)<1e-6: x_levels.append(x1)
                        if abs(y1-y2)<1e-6: y_levels.append(y1)
                elif isinstance(g, Point):
                    x,y,_=to_local_point(g, cs); x_levels.append(x); y_levels.append(y)

        x_levels = uniq_sorted(x_levels, EPS)
        y_levels = uniq_sorted(y_levels, EPS)

        # генерим зоны
        zones=[]
        for yi in range(len(y_levels)-1):
            y0,y1 = y_levels[yi], y_levels[yi+1]
            for xi in range(len(x_levels)-1):
                x0,x1 = x_levels[xi], x_levels[xi+1]
                if rect_inside_strict(x0,y0,x1,y1, V):
                    bl=Point.ByCartesianCoordinates(cs,x0,y0,0)
                    br=Point.ByCartesianCoordinates(cs,x1,y0,0)
                    tr=Point.ByCartesianCoordinates(cs,x1,y1,0)
                    tl=Point.ByCartesianCoordinates(cs,x0,y1,0)
                    zones.append(PolyCurve.ByPoints([bl,br,tr,tl,bl]))
        all_zones.extend(zones)

    OUT = all_zones
# ----------------------------------------

code_block_30 = CodeBlock(contour_mainBaseline=code_block_6, zone_hasPoints=code_block_17.zone_hasPoints, zone_nonPoints=деление) { contour_mainBaseline; zone_hasPoints; zone_nonPoints; }

# group: Поиск смежных между двумя списками
code_block_31 = CodeBlock(input1=code_block_30.zone_nonPoints, input2=code_block_30.zone_hasPoints) { input1; input2; }
python_script_6 = Python(IN[0]=code_block_31.input2, IN[1]=code_block_31.input1)  # CPython3; same code as python_script_5
getItemAtIndex_2 = List.GetItemAtIndex(list=code_block_31.input1, index=python_script_6)

getItemAtIndex_3 = List.GetItemAtIndex(list=code_block_29.has_points, index=python_script_6)
code_block_32 = CodeBlock(a=getItemAtIndex_3, b=integer_slider) { a[b]; }
code_block_33 = CodeBlock(a=code_block_32) { a; }
code_block_34 = CodeBlock(a=getItemAtIndex_2, b=integer_slider) { a[b]; }
code_block_35 = CodeBlock(a=code_block_27.no_points, b=integer_slider) { a[b]; }

# group: Объединение
curves = PolyCurve.Curves()  # unwired: polyCurve
python_script_7 = Python(IN[0]=code_block_34, IN[1]=curves)  # CPython3; same code as python_script_5
flatten_2 = List.Flatten(list=python_script_7)
getItemAtIndex_4 = List.GetItemAtIndex(list=curves, index=flatten_2)
length = Curve.Length(curve=getItemAtIndex_4)
code_block_36 = CodeBlock(out=code_block_35) { out; }
code_block_37 = CodeBlock {  }

maximumItem = List.MaximumItem(list=length)
eq = length == maximumItem
filterByBoolMask_3 = List.FilterByBoolMask(list=code_block_33, mask=eq)

# group: Если равное количество
maximumItem_2 = List.MaximumItem(list=filterByBoolMask_3.in)
eq_2 = filterByBoolMask_3.in == maximumItem_2
countTrue_2 = List.CountTrue(list=eq_2)
code_block_38 = CodeBlock { 1; }
gt = countTrue_2 > code_block_38

code_block_39 = CodeBlock(main=code_block_35) { main; }
python_script_8 = Python(IN[0]=code_block_39)  # CPython3
# ---------- python_script_8.python (157 lines) ----------
# Dynamo Python script
# Split a closed polycurve (polygon) into two polygons of equal area.
# The split line is parallel to the longest polygon edge.
# Inputs:
#   IN[0] : polygon (Autodesk.DesignScript Geometry Polygon / PolyCurve) or list of points
# Output:
#   OUT[0] : polygon A (Dynamo Polygon)
#   OUT[1] : polygon B (Dynamo Polygon)

import clr
clr.AddReference('ProtoGeometry')
from Autodesk.DesignScript.Geometry import Point, Polygon, PolyCurve

# read input
src = IN[0]

# helpers to extract 2D point tuples from several possible input shapes
def to_point_list(obj):
    # if it's already a list of Dynamo Points
    try:
        if isinstance(obj, list) and len(obj)>0 and hasattr(obj[0], 'X'):
            return [(p.X, p.Y) for p in obj]
    except:
        pass
    # if it's a Dynamo Polygon or PolyCurve with Vertices/Points
    try:
        pts = []
        if hasattr(obj, "Vertices"):
            for v in obj.Vertices:
                pts.append((v.X, v.Y))
            return pts
        if hasattr(obj, "Points"):
            for v in obj.Points:
                pts.append((v.X, v.Y))
            return pts
    except:
        pass
    # maybe it's a single curve exposing Coordinates
    try:
        if hasattr(obj, "Coordinates"):
            return [(c.X, c.Y) for c in obj.Coordinates]
    except:
        pass
    # fallback: if given as list of tuples already
    if isinstance(obj, list) and len(obj)>0 and isinstance(obj[0], (tuple, list)):
        return [(float(x), float(y)) for x,y in obj]
    return None

pts = to_point_list(src)
if not pts or len(pts) < 3:
    OUT = [src, None]
else:
    # ensure polygon is closed (last != first)
    if pts[0] != pts[-1]:
        pts = pts[:]
        pts.append(pts[0])

    # vector helpers
    def sub(a,b): return (a[0]-b[0], a[1]-b[1])
    def add(a,b): return (a[0]+b[0], a[1]+b[1])
    def mul(a,s): return (a[0]*s, a[1]*s)
    def dot(a,b): return a[0]*b[0] + a[1]*b[1]
    def length(a): 
        import math
        return math.hypot(a[0], a[1])

    # find longest edge direction
    maxlen = -1.0
    maxdir = (1.0, 0.0)
    for i in range(len(pts)-1):
        a = pts[i]
        b = pts[i+1]
        v = sub(b,a)
        l = length(v)
        if l > maxlen:
            maxlen = l
            if l > 0:
                maxdir = (v[0]/l, v[1]/l)

    # unit direction parallel to longest edge
    v = maxdir
    # normal direction (perpendicular) we will move along to place the cut
    n = (-v[1], v[0])

    # polygon area (shoelace), expects closed polygon (last repeats first)
    def polygon_area(poly):
        a = 0.0
        for i in range(len(poly)-1):
            x1,y1 = poly[i]
            x2,y2 = poly[i+1]
            a += x1*y2 - x2*y1
        return abs(a) * 0.5

    total_area = polygon_area(pts)

    # clip polygon to half-space defined by n·p <= t (Sutherland-Hodgman)
    def clip_halfspace(poly, nvec, t):
        res = []
        for i in range(len(poly)-1):
            P = poly[i]
            Q = poly[i+1]
            dP = dot(nvec, P) - t
            dQ = dot(nvec, Q) - t
            # if P inside, include
            if dP <= 0:
                res.append(P)
            # edge crosses boundary?
            if dP * dQ < 0:
                # compute intersection
                s = dP / (dP - dQ)
                inter = add(P, mul(sub(Q,P), s))
                res.append(inter)
        # close if not empty
        if len(res) > 0 and res[0] != res[-1]:
            res.append(res[0])
        return res

    # compute projection min/max for search range
    projs = [dot(n, p) for p in pts[:-1]]
    pmin = min(projs) - 1e-6
    pmax = max(projs) + 1e-6

    # bisection search for t where left area approx equals half
    target = total_area * 0.5
    lo = pmin
    hi = pmax
    t = (lo + hi) / 2.0
    for _ in range(60):
        t = (lo + hi) / 2.0
        left_poly = clip_halfspace(pts, n, t)
        a_left = polygon_area(left_poly) if len(left_poly) >= 4 else 0.0
        if a_left > target:
            hi = t
        else:
            lo = t

    t = (lo + hi) / 2.0
    polyA_pts = clip_halfspace(pts, n, t)       # n·p <= t
    # other half: clip by opposite half-space (n·p >= t) => clip with -n and -t for <= form
    negn = (-n[0], -n[1])
    polyB_pts = clip_halfspace(pts, negn, -t)

    # construct Dynamo polygons (Polygon.ByPoints expects list of Point)
    def make_polycurve_from_xy(xylist):
        if not xylist or len(xylist) < 4:
            return None
        points = [Point.ByCoordinates(x,y,0) for x,y in xylist[:-1]]  # exclude duplicated last
        try:
            return PolyCurve.ByPoints(points)
        except:
            # fallback to polycurve via creating closed point list
            return PolyCurve.ByPoints(points)

    polyA = make_polycurve_from_xy(polyA_pts)
    polyB = make_polycurve_from_xy(polyB_pts)

    OUT = [polyA, polyB]
# ----------------------------------------
closeWithLine = PolyCurve.CloseWithLine(polyCurve=python_script_8)
if_ = RefactoredIf(test=gt, true=closeWithLine, false=code_block_36)
countTrue_3 = List.CountTrue(list=eq)
code_block_40 = CodeBlock { 1; }
gt_2 = countTrue_3 > code_block_40
code_block_41 = CodeBlock(a=code_block_34) { a; }
filterByBoolMask_4 = List.FilterByBoolMask(list=code_block_41, mask=eq)

# group: Примыкает к той что с меньшей площадью
code_block_42 = CodeBlock(a=filterByBoolMask_4.in) { a; }
byPatch_4 = Surface.ByPatch(closedCurve=code_block_42)
area = Surface.Area(surface=byPatch_4)
minimumItem = List.MinimumItem(list=area)
indexOf = List.IndexOf(list=area, element=minimumItem)
getItemAtIndex_5 = List.GetItemAtIndex(list=code_block_42, index=indexOf)

if_2 = RefactoredIf(test=gt, true=code_block_42, false=getItemAtIndex_5)

# group: Поиск смежный внутри списка
code_block_43 = CodeBlock(input1=code_block_27.no_points) { input1; }
code_block_44 = CodeBlock { 0.01; }
python_script_9 = Python(IN[0]=code_block_43, IN[1]=code_block_44)  # CPython3; same code as python_script_5
getItemAtIndex_6 = List.GetItemAtIndex(list=code_block_43, index=python_script_9)

code_block_45 = CodeBlock { null; }

# group (continued): Объединение
indexOf_2 = List.IndexOf(list=length, element=maximumItem)
getItemAtIndex_7 = List.GetItemAtIndex(list=code_block_34, index=indexOf_2)

# group: Если больше 1го красного
code_block_46 = CodeBlock(a=getItemAtIndex_6, b=integer_slider) { a[b]; }
count = List.Count(list=code_block_46)
code_block_47 = CodeBlock { 1; }
gt_3 = count > code_block_47
if_3 = RefactoredIf(test=gt_3, true=code_block_45, false=getItemAtIndex_7)

if_4 = RefactoredIf(test=gt_2, true=if_2, false=if_3)

# group (continued): Объединение
list_create_2 = List.Create(item0=if_, item1=if_4)

transpose = List.Transpose(lists=list_create_2)

# group (continued): Объединение
byPatch_5 = Surface.ByPatch(closedCurve=transpose)
byUnion = Surface.ByUnion(surfaces=byPatch_5)
perimeterCurves = Surface.PerimeterCurves(surface=byUnion)
byJoinedCurves = PolyCurve.ByJoinedCurves(curves=perimeterCurves)

color_palette_9 = ColorPalette({R: 255, G: 0, B: 0, A: 255})
byGeometryColor_5 = Modifiers.GeometryColor.ByGeometryColor(geometry=getItemAtIndex_6, color=color_palette_9)
code_block_48 = CodeBlock(a=byGeometryColor_5, b=integer_slider) { a[b]; }
color_palette_10 = ColorPalette({R: 0, G: 128, B: 254, A: 255})
byGeometryColor_6 = Modifiers.GeometryColor.ByGeometryColor(geometry=perimeterCurves, color=color_palette_10)
code_block_49 = CodeBlock {  }
if_5 = RefactoredIf(test=gt, true=code_block_45, false=getItemAtIndex_5)
code_block_50 = CodeBlock { 100; }
components_2 = Color.Components(color=color_palette_8)
byARGB_2 = Color.ByARGB(alpha=code_block_50, red=components_2.red, green=components_2.green, blue=components_2.blue)
code_block_51 = CodeBlock { 200; }
color_palette_11 = ColorPalette({R: 59, G: 254, B: 5, A: 255})
components_3 = Color.Components(color=color_palette_11)
byARGB_3 = Color.ByARGB(alpha=code_block_51, red=components_3.red, green=components_3.green, blue=components_3.blue)
byGeometryColor_7 = Modifiers.GeometryColor.ByGeometryColor(geometry=code_block_34, color=byARGB_3)

# group: CoreNodeModels.ColorRange
# Inserted Dynamo graph
byPatch_6 = Surface.ByPatch(closedCurve=деление)
code_block_52 = CodeBlock(input=byPatch_6) { input; }
color_palette_12 = ColorPalette({R: 255, G: 0, B: 0, A: 255})
color_palette_13 = ColorPalette({R: 255, G: 127, B: 1, A: 255})
color_palette_14 = ColorPalette({R: 255, G: 255, B: 0, A: 255})
color_palette_15 = ColorPalette({R: 125, G: 255, B: 2, A: 255})
list_create_3 = List.Create(item0=color_palette_12, item1=color_palette_13, item2=color_palette_14, item3=color_palette_15)
code_block_53 = CodeBlock(c=list_create_3) { 0..1..#List.Count(c); }
code_block_54 = CodeBlock(c=code_block_52) { 0..1..#List.Count(c); }
color_range_2 = ColorRange(colors=list_create_3, indices=code_block_53, value=code_block_54)
code_block_55 = CodeBlock(t1=color_range_2)
# ---------- code_block_55.designscript (6 lines) ----------
t2 = DSCore.Color.Components(t1);
t3 = Dictionary.ValueAtKey(t2, "alpha");
t4 = Dictionary.ValueAtKey(t2, "red");
t5 = Dictionary.ValueAtKey(t2, "green");
t6 = Dictionary.ValueAtKey(t2, "blue");
color1 = DSCore.Color.ByARGB(20, t4, t5, t6);
# ----------------------------------------
byGeometryColor_8 = Modifiers.GeometryColor.ByGeometryColor(geometry=code_block_52, color=code_block_55.color1)

# group: Дополнительное разделение зон > Деление контура на сегменты
деление_2 = Python(IN[0]=code_block_20, IN[1]=python_script_4)  # CPython3; same code as деление

# group: Получение светильников > Получение объектов
getAllObjectTypes_2 = DynRenga.RengaAPI.Constants.ObjectTypes.GetAllObjectTypes()
code_block_56 = CodeBlock { "Column"; }
valueAtKey_3 = DesignScript.Builtin.Dictionary.ValueAtKey(dictionary=getAllObjectTypes_2.ObjectTypes, key=code_block_56)
getObjectsByType_2 = DynRenga.RengaAPI.IModelObjectCollection.GetObjectsByType(iModelObjectCollection=getObjects, objectType=valueAtKey_3)
id_2 = DynRenga.RengaAPI.IModelObject.Id(iModelObject=getObjectsByType_2)

# group: Получение светильников
getParameters_2 = DynRenga.RengaAPI.IModelObject.GetParameters(iModelObject=getObjectsByType_2)
getAllParameters_2 = DynRenga.RengaAPI.IParameterContainer.GetAllParameters(iParameterContainer=getParameters_2)
definition_2 = DynRenga.RengaAPI.IParameter.Definition(iParameter=getAllParameters_2)
text_2 = DynRenga.RengaAPI.IParameterDefinition.Text(iParameterDefinition=definition_2)
getQuantities_2 = DynRenga.RengaAPI.IModelObject.GetQuantities(iModelObject=getObjectsByType_2)
project_2 = DynRenga.RengaAPI.IApplication.Project(iApplication=IApplication)
IDataExporter_2 = DynRenga.RengaAPI.IDataExporter.IDataExporter(project=project_2)
getObjects3D_2 = DynRenga.RengaAPI.IDataExporter.GetObjects3D(iDataExporter=IDataExporter_2)
getAllObjects_2 = DynRenga.RengaAPI.IExportedObject3DCollection.GetAllObjects(iExportedObject3DCollection=getObjects3D_2)
getObjectsByModelObjectId_2 = DynRenga.RengaAPI.IExportedObject3DCollection.GetObjectsByModelObjectId(iExportedObject3DCollection=getObjects3D_2, modelObjectId=id_2)
exportedObjectToDynamoGeometry_2 = DynRenga.Converters.Renga.MeshConverter.ExportedObjectToDynamoGeometry(exported=getObjectsByModelObjectId_2)
code_block_57 = CodeBlock { 50; }
color_palette_16 = ColorPalette({R: 255, G: 0, B: 73, A: 255})
components_4 = Color.Components(color=color_palette_16)
byARGB_4 = Color.ByARGB(alpha=code_block_57, red=components_4.red, green=components_4.green, blue=components_4.blue)
byMeshColors_2 = Modifiers.GeometryColor.ByMeshColors(mesh=exportedObjectToDynamoGeometry_2.Meshes, colors=byARGB_4)
exportedObjectToBoundingBox_2 = DynRenga.Converters.Renga.MeshConverter.ExportedObjectToBoundingBox(exported=getObjectsByModelObjectId_2)
toCuboid_2 = BoundingBox.ToCuboid(boundingBox=exportedObjectToBoundingBox_2)
vertexPositions_2 = Mesh.VertexPositions(mesh=exportedObjectToDynamoGeometry_2.Meshes)
byBestFitThroughPoints_3 = Circle.ByBestFitThroughPoints(points=vertexPositions_2)
byBestFitThroughPoints_4 = Line.ByBestFitThroughPoints(bestFitPoints=vertexPositions_2)
code_block_58 = CodeBlock { 0.5; }

# group: Получение светильников > Выбор точек
centroid_2 = Solid.Centroid(solid=toCuboid_2)
centerPoint_2 = Circle.CenterPoint(circle=byBestFitThroughPoints_3)
code_block_59 = CodeBlock(choice=centerPoint_2) { choice; }
pointAtParameter_2 = Curve.PointAtParameter(curve=byBestFitThroughPoints_4, param=code_block_58)

getContour = DynRenga.RengaAPI.IRegion2D.GetContour()  # unwired: iRegion2D, index
IProfile = DynRenga.RengaAPI.IProfile.IProfile()  # unwired: profile
isInitialized = DynRenga.RengaAPI.IColumnStyle.IsInitialized()  # unwired: iColumnStyle
IColumnStyle = DynRenga.RengaAPI.IColumnStyle.IColumnStyle()  # unwired: style
IColumnStyle_2 = DynRenga.RengaAPI.IColumnStyle.IColumnStyle()  # unwired: style
getProfilePlacement = DynRenga.RengaAPI.IColumnParams.GetProfilePlacement()  # unwired: iColumnParams
code_block_60 = CodeBlock {  }
project_3 = DynRenga.RengaAPI.IApplication.Project(iApplication=IApplication)
getColumnStyleManager = DynRenga.RengaAPI.IProject.GetColumnStyleManager(iProject=project_3)
idS = DynRenga.RengaAPI.IParameter.IdS(iParameter=getAllParameters_2)
code_block_61 = CodeBlock { "{19BCC807-6EC4-46D7-B9C7-B4F24B0C65B8}"; }
eq_3 = idS == code_block_61
code_block_62 = CodeBlock { true; }
indexOf_3 = List.IndexOf(list=eq_3, element=code_block_62, lacing=Longest)
getItemAtIndex_8 = List.GetItemAtIndex(list=getAllParameters_2, index=indexOf_3, lacing=Longest)
getIntValue = DynRenga.RengaAPI.IParameter.GetIntValue(iParameter=getItemAtIndex_8)
getColumnStyle = DynRenga.RengaAPI.IColumnStyleManager.GetColumnStyle(iColumnStyleManager=getColumnStyleManager, id=getIntValue)
profile = DynRenga.RengaAPI.IColumnStyle.Profile(iColumnStyle=getColumnStyle)
regions = DynRenga.RengaAPI.IProfile.Regions(iProfile=profile)
getAll = DynRenga.RengaAPI.IRegion2DCollection.GetAll(iRegion2DCollection=regions)
getOuterContour = DynRenga.RengaAPI.IRegion2D.GetOuterContour(iRegion2D=getAll)
toDynamoPolyCurveOptimized_2 = DynRenga.Converters.Renga.Curve2DConverter.ToDynamoPolyCurveOptimized(curve2D=getOuterContour)

# group: Получение контура
code_block_63 = CodeBlock { "IColumnParams"; }
getInterfaceByName_3 = DynRenga.RengaAPI.IModelObject.GetInterfaceByName(iModelObject=getObjectsByType_2, interfaceName=code_block_63)

getProfilePlacement_2 = DynRenga.RengaAPI.IColumnParams.GetProfilePlacement(iColumnParams=getInterfaceByName_3)
placement2DToCoordinateSystem = DynRenga.Converters.Renga.PlacementConverter.Placement2DToCoordinateSystem(placement=getProfilePlacement_2)
transform_3 = Geometry.Transform(geometry=toDynamoPolyCurveOptimized_2, cs=placement2DToCoordinateSystem, lacing=Longest)
position = DynRenga.RengaAPI.IColumnParams.Position(iColumnParams=getInterfaceByName_3)
rengaToDynamoArray = DynRenga.Converters.Renga.Point3DConverter.RengaToDynamoArray(rengaPoints=position)
byOrigin = CoordinateSystem.ByOrigin(origin=rengaToDynamoArray.points)
transform_4 = Geometry.Transform(geometry=transform_3, cs=byOrigin)
inverse_2 = CoordinateSystem.Inverse(coordinateSystem=placement3DToCoordinateSystem)
transform_5 = Geometry.Transform(geometry=transform_4, cs=inverse_2, lacing=Longest)
code_block_64 = CodeBlock(a=rengaToDynamoArray.points) { a; }
color_palette_17 = ColorPalette({R: 255, G: 127, B: 1, A: 255})
byGeometryColor_9 = Modifiers.GeometryColor.ByGeometryColor(geometry=flatten, color=color_palette_17)
integer_slider_2 = IntegerSlider(7, range=0..20 step 1)
code_block_65 = CodeBlock(a=code_block_31.input2, b=integer_slider_2) { a[b]; }
byPatch_7 = Surface.ByPatch(closedCurve=code_block_65)
color_palette_18 = ColorPalette({R: 255, G: 0, B: 0, A: 255})
byGeometryColor_10 = Modifiers.GeometryColor.ByGeometryColor(geometry=byPatch_7, color=color_palette_18)
getItemAtIndex_9 = List.GetItemAtIndex()  # unwired: list, index
code_block_66 = CodeBlock { true; }
allIndicesOf = List.AllIndicesOf(item=code_block_66)  # unwired: list
code_block_67 = CodeBlock(a=getItemAtIndex_2, b=integer_slider_2) { a[b]; }
byPatch_8 = Surface.ByPatch(closedCurve=code_block_67)
color_palette_19 = ColorPalette({R: 255, G: 192, B: 0, A: 255})
byGeometryColor_11 = Modifiers.GeometryColor.ByGeometryColor(geometry=byPatch_8, color=color_palette_19)
color_palette_20 = ColorPalette({R: 0, G: 128, B: 254, A: 255})
byGeometryColor_12 = Modifiers.GeometryColor.ByGeometryColor(geometry=code_block_17.zone_hasPoints, color=color_palette_20)
color_palette_21 = ColorPalette({R: 255, G: 127, B: 1, A: 255})
byGeometryColor_13 = Modifiers.GeometryColor.ByGeometryColor(geometry=деление, color=color_palette_21)
code_block_68 = CodeBlock {  }
join = List.Join()  # unwired: list0, list1
combine = List.Combine(combineFunction=join, list0=getItemAtIndex_2, list1=code_block_31.input2)
